vi "Main.gvi"   [LabVIEW NXG 5.0.0]
# This template is for the Queued Message Handler design pattern. The Event Handling Loop generates messages based on user interface actions. The Message Handling Loop processes messages generated by the Event Handling Loop, or by other messages. The messages are string values, so new messages can be added easily to the Message Cases case structure in the Message Handling Loop. Each message cluster can also provide an optional value for Message Data, which is a variant that can be converted to whatever message-specific data is required.
panel controls:
  "Exit": bool
  "CMD Button": bool
  "Initialize Software": bool
  "Panel Config Button": bool
  "Set PV Angle Button": bool
  "IR Thermometer Position": bool
  "Fans Button": bool
  "Brightness Config Button": bool
  "Optic Filter Config Button": bool
  "Panel Config Selector": string
  "PV Angle": i32
  "Fans Selector": string
  "Optic Filter Selector": string
  "IR Thermometer Position Selector": string
  "Light Power": i32
  "Manual Command to Arduino": string = "@DO 34 0#"
  "Set LoadR": bool
  "No Load": bool
  "Set LoadRTotal": string
  "VAC Button": bool
  "Heat Selector": string
  "Heat Button": bool
  "Exit 2": bool
  "Do Something": bool
  "Do Something Else": bool
  "Tab": i32
  "LoadR1": string
  "LoadR10": string
  "LoadR100": string
  "LoadR1000": string
  "Measured Data": "Measured Data.gtype"
  "Receive MV": bool
  "Arduino COM Port": "VISA Instr" = "COM5"
  "Panel Type Config Button": bool
  "Panel Type Config": string
  "Load Type Config Button": bool
  "Load Type Config": string
  "VAC Pause": bool
  "VAC Stop": bool
  "Button": bool
  "Current array": f64[]
  "Total Load temp": f64[]
  "Voltage temp": f64[]
  "VAC Volt": f64[]
  "VAC Cur": f64[]
  "VAC Load": f64[]
  "VAC measurements": i32 = 20
panel indicators:
  "Display": string
  "Arduino Command Reply": "ArduinoReply.gtype"
  "Hardware Status": string
  "Voltage 1": f64
  "Current 1": f64
  "VAC Load Counter": i32
  "MV-Panel Configuration": string
  "MV-Cooling": string
  "MV-Heating": string
  "MV-Optical Filter": string
  "MV-Panel Tilt Angle": string
  "MV-Light Power": string
  "MV-LoadR1": string
  "MV-LoadR2": string
  "MV-LoadR3": string
  "MV-LoadR4": string
  "API Key": string
  "Server URL": string
  "Status of Send to SystemLink Cycle": string
  "PV-Current, mA": f64
  "SendDoubleToCloud": string
  "PV-LoadR,Ohm": f64
  "PV-Voltage, V": f64
  "PV-Temperature, ºC": f64
  "PV-LightIntensity, W/m2": f64
  "PV-Panel Tilt Angle, º": f64
  "PV-Panel Cofiguration": string
  "SendStringToCloud": string
  "PV-Cooling": string
  "PV-Heating": string
  "PV-Optical Filter": string
  "PV-LoadR1": string
  "PV-LoadR2": string
  "PV-LoadR3": string
  "PV-LoadR4": string
  "Error out Systemlink Read Cycle": error
  "Arduino Status": string
  "SendArrayDoubleToCloud": string
  "TempSensor": f64
  "LuxSensor": f64
  "Set Load R": i32
  "MV-LoadRTotal": string
  "TempSensor IR": f64
  "PV-LoadRTotal": string
  "PV-Temperature IR Position": string
  "PV-LigthPower, %": f64
  "PV-Temperature IR, ºC": f64
  "Total LoadR_SET": string
  "Dimmer": f64
  "VOLTShunt1": f64
  "Power1": f64
  "I-V Curve (VAC)": cluster{"Element 1": f64[], "Element 2": f64[]}
  "Load Reply": string
  "Chart Volt": f64
  "Chart Current": f64
  "Chart Load": i32
  "Chart Lux": f64
  "Chart Temperature": f64
  "PV-Lab Status": string
  "Arduino Status_2": bool
types:
  "ArduinoReply.gtype" = cluster{"Timestamp": timestamp, "DATA": string}
  "Measured Data.gtype" = cluster{"Voltage, V": f64, "Current, mA": f64, "Luminous Flux, Lux": f64, "Temperature, GradC": f64, "Temperature IR, GradC": f64}
  "UI Data.gtype" = cluster{"Boolean": bool, "String": string, "Numeric": f64}
uses:
  NI::Skyline::Configuration::Open Configuration API Key.gvi
  NI::Skyline::TagHTTP::Query Tags.gvi
  NI::Skyline::TagHTTP::Open Tag.gvi
  NI::Skyline::TagHTTP::Read Tag (String).gvi
  NI::Skyline::TagHTTP::Close Tag (Single).gvi
  NI::Skyline::Configuration::Close Configuration.gvi
  Message Queue::Create All Message Queues.gvi
  Message Queue::Enqueue Message (Single).gvi
  Support::Error Handler - Event Handling Loop.gvi
  Message Queue::Dequeue Message.gvi
  NI::VISA::Configure Serial Port (Instr).gvi
  NI::VISA::Open (Instr).gvi
  Queued Message Handler::VISA WriteRead.gvi
  Queued Message Handler::VISA Reply Parse.gvi
  Queued Message Handler::Panel Switch.gvi
  Queued Message Handler::VISA Multiple Write.gvi
  NI::Analysis::Statistics::Mean (DBL).gvi
  NI::G Core::Error::Display Error.gvi
  NI::VISA::Close (Instr).gvi
  NI::G Core::Error::Build Error Cluster.gvi
  Support::Error Handler - Message Handling Loop.gvi
  NI::Skyline::TagHTTP::Write Tag (DBL).gvi
  NI::Skyline::TagHTTP::Write Tag (String).gvi
  NI::Vision::IMAQdx::Initialize.gvi
  NI::Vision::IMAQdx::Configure Grab.gvi
  NI::Vision::Core::Basics::Create Image.gvi
  NI::Vision::IMAQdx::Grab.gvi
  NI::Vision::IMAQdx::Close.gvi
diagram:
  $"MV-Panel Configuration" <- ""
  $"MV-Cooling" <- ""
  $"MV-Heating" <- ""
  $"MV-Optical Filter" <- ""
  $"MV-Panel Tilt Angle" <- ""
  $"MV-Light Power" <- ""
  $"MV-LoadR1" <- ""
  $"MV-LoadR2" <- ""
  $"MV-LoadR3" <- ""
  $"MV-LoadR4" <- ""
  $"MV-LoadRTotal" <- ""
  # PV Config
  # 	Single
  # 	Parallel 2
  # 	Parallel 2 Diode
  # 	Series 2
  # 	Series 2 Diode
  # 	Parallel 4
  # 	Parallel 4 Diode
  # 	Series 4
  # 	Series 4 Diode
  # 	Parallel Of Series
  # 	Parallel Of Series Diode
  # 	Series Of Parallel
  # 	Series Of Parallel Diode
  # Optic Filter Config
  # 	No Filter
  # 	Filter 1
  # 	Filter 2
  # IR Thermomether
  # 	None
  # 	Panel 1
  # 	Panel 2
  # 	Panel 3
  # 	Panel 4
  # Heating/Cooling
  # 	0
  # 	50
  # 	100
  # Light Power
  # 	0 ... 100
  # Panel Tilt Angle
  # 	0 ... 120
  # Load 1
  # 	1,2,3,5;
  # Load 2
  # 	10,20.40,50;
  # Load 3
  # 	100,200,400,500;
  # Load 4
  # 	1000,2000,4000;
  w1 = ["MV-Panels Configuration", "MV-Cooling", "MV-Heating", "MV-Optical Filter", "MV-Panel Tilt Angle", "MV-Light Power", "MV-LoadR1", "MV-LoadR2", "MV-LoadR3", "MV-LoadR4", "MV-LoadRTotal"]
  Array Size(array=w1) -> (size(s)=w2)
  Initialize Array(element=1904-12-31T23:00:00Z, size=w2) -> w3
  sequence {
    frame 0 {
      Wait(time to wait=20000)
    }
  }
  s1 = w3  # shift register
  while {
    Wait(time to wait=500)
    case ($"Receive MV") {
      frame False, Default {
        w4 = s1
      }
      frame True {
        call "Open Configuration API Key.gvi"(server url=$"Server URL", api key=$"API Key") -> (configuration=w5, error out=w6)
        call "Query Tags.gvi"(paths=w1, error in=w6, configuration=w5) -> (tags=w7, error out=w8)
        Build Array(reference to "MV-Panel Configuration", reference to "MV-Cooling", reference to "MV-Heating", reference to "MV-Optical Filter", reference to "MV-Panel Tilt Angle", reference to "MV-Light Power", reference to "MV-LoadR1", reference to "MV-LoadR2", reference to "MV-LoadR3", reference to "MV-LoadR4", reference to "MV-LoadRTotal") -> w9
        for {
          w10 = each element of w7
          w11 = each element of s1
          w12 = each element of w9
          Property Node(instance in=w10) -> ("Path"=w13, "Datatype"=w14)
          call "Open Tag.gvi"(path=w13, data type=w14, error in=w8, configuration=w5) -> (tag=w15, error out=w16)
          call "Read Tag (String).gvi"(tag in=w15, error in=w16) -> (value=w17, time stamp=w18, error out=w19)
          Is Greater(x=w18, y=w11) -> w20
          case (w20) {
            frame False, Default { }
            frame True {
              Property Node(instance in=w12, "ValueSignaling"=w17)
            }
          }
          append w18 to w4
        }
        for {
          w21 = each element of w7
          call "Close Tag (Single).gvi"(tag=w21, error in=w19) -> (error out=w22)
        }
        call "Close Configuration.gvi"(configuration=w5, error in=w22) -> (error out=w23)
        $"Error out Systemlink Read Cycle" <- w23
      }
    }
    next s1 = w4
    stop if $"Exit 2"
  }
  disable {
    frame Enabled { }
    frame Disabled {
      Destroy User Event()
    }
  }
  w24 = bool FALSE  # Stop Event
  Create User Event[EventName="Stop Event"](user event data type=w24) -> (error out=w25, user event out=w26)
  Register For Events("Stop Event"=w26) -> (event registration refnum out=w27)
  call "Create All Message Queues.gvi"(error in=w25) -> (message queues=w28, error out=w29)
  Property Node(instance in=w28) -> ("UI"=w30)
  s2 = w27  # shift register
  while {
    event (dynamic events = s2) {
      on "Exit" Value changed {
        call "Enqueue Message (Single).gvi"(priority message=TRUE, message queue in=w30, message="Exit") -> (message queue out=w33, error out=w32)
        w31 = default
      }
      on dynamic event 0 {
        $Display <- "\"Exit\" button pressed"
        w31 = TRUE
        w32 = default
        w33 = w30
      }
      on "Window" Close? {
        call "Enqueue Message (Single).gvi"(priority message=TRUE, message queue in=w30, message="Exit") -> (message queue out=w33)
        Event Filter("Discard?"=TRUE)
        w31 = default
        w32 = default
      }
      on "Initialize Software" Value changed {
        call "Enqueue Message (Single).gvi"(message queue in=w30, message="Initialize") -> (message queue out=w33, error out=w32)
        w31 = default
      }
      on "CMD Button" Value changed {
        call "Enqueue Message (Single).gvi"(message queue in=w30, message="Send CMD") -> (message queue out=w33, error out=w32)
        w31 = default
      }
      on "Panel Config Button" Value changed {
        call "Enqueue Message (Single).gvi"(message queue in=w30, message="Panel Config", message data=$"Panel Config Selector") -> (message queue out=w33, error out=w32)
        w31 = default
      }
      on "Panel Type Config Button" Value changed {
        call "Enqueue Message (Single).gvi"(message queue in=w30, message="Panel Type Switch", message data=$"Panel Type Config") -> (message queue out=w33, error out=w32)
        w31 = default
      }
      on "Load Type Config Button" Value changed {
        call "Enqueue Message (Single).gvi"(message queue in=w30, message="Load Type Switch", message data=$"Load Type Config") -> (message queue out=w33, error out=w32)
        w31 = default
      }
      on "MV-Panel Configuration" Value changed {
        Event Data() -> ("New Value"=w34)
        call "Enqueue Message (Single).gvi"(message queue in=w30, message="PV Config", message data=w34) -> (message queue out=w33, error out=w32)
        w31 = default
      }
      on "Heat Button" Value changed {
        call "Enqueue Message (Single).gvi"(message queue in=w30, message="Heat Config", message data=$"Heat Selector") -> (message queue out=w33, error out=w32)
        w31 = default
      }
      on "MV-Heating" Value changed {
        Event Data() -> ("New Value"=w35)
        call "Enqueue Message (Single).gvi"(message queue in=w30, message="Heat Config", message data=w35) -> (message queue out=w33, error out=w32)
        w31 = default
      }
      on "Set PV Angle Button" Value changed {
        call "Enqueue Message (Single).gvi"(message queue in=w30, message="Set PV Angle", message data=$"PV Angle") -> (message queue out=w33, error out=w32)
        w31 = default
      }
      on "MV-Panel Tilt Angle" Value changed {
        Event Data() -> ("New Value"=w36)
        Decimal String To Number(string=w36) -> (offset past number=w37)
        call "Enqueue Message (Single).gvi"(message queue in=w30, message="Set PV Angle", message data=w37) -> (message queue out=w33, error out=w32)
        w31 = default
      }
      on "IR Thermometer Position" Value changed {
        call "Enqueue Message (Single).gvi"(message queue in=w30, message="IR Thermometer Position", message data=$"IR Thermometer Position Selector") -> (message queue out=w33, error out=w32)
        w31 = default
      }
      on "Fans Button" Value changed {
        call "Enqueue Message (Single).gvi"(message queue in=w30, message="Fans Control", message data=$"Fans Selector") -> (message queue out=w33, error out=w32)
        w31 = default
      }
      on "MV-Cooling" Value changed {
        Event Data() -> ("New Value"=w38)
        call "Enqueue Message (Single).gvi"(message queue in=w30, message="Fans Control", message data=w38) -> (message queue out=w33, error out=w32)
        w31 = default
      }
      on "Brightness Config Button" Value changed {
        call "Enqueue Message (Single).gvi"(message queue in=w30, message="Brightness Config", message data=$"Light Power") -> (message queue out=w33, error out=w32)
        w31 = default
      }
      on "MV-Light Power" Value changed {
        Event Data() -> ("New Value"=w39)
        call "Enqueue Message (Single).gvi"(message queue in=w30, message="Brightness Config", message data=w39) -> (message queue out=w33, error out=w32)
        w31 = default
      }
      on "Optic Filter Config Button" Value changed {
        call "Enqueue Message (Single).gvi"(message queue in=w30, message="Optic Filter Config", message data=$"Optic Filter Selector") -> (message queue out=w33, error out=w32)
        w31 = default
      }
      on "MV-Optical Filter" Value changed {
        Event Data() -> ("New Value"=w40)
        call "Enqueue Message (Single).gvi"(message queue in=w30, message="Optic Filter Config", message data=w40) -> (message queue out=w33, error out=w32)
        w31 = default
      }
      on "Set LoadR" Value changed; "Set LoadRTotal" Value changed {
        Is Empty String Or Path(string/path=$"Set LoadRTotal") -> w41
        Concatenate Strings($LoadR1, $LoadR10, $LoadR100, $LoadR1000) -> w42
        Select(s=w41, t=w42, f=$"Set LoadRTotal") -> w43
        call "Enqueue Message (Single).gvi"(message queue in=w30, message="Set LoadR", message data=w43) -> (message queue out=w33, error out=w32)
        w31 = default
      }
      on "MV-LoadRTotal" Value changed {
        Event Data() -> ("New Value"=w44)
        call "Enqueue Message (Single).gvi"(message queue in=w30, message="Set LoadR", message data=w44) -> (message queue out=w33, error out=w32)
        w31 = default
      }
      on "No Load" Value changed {
        call "Enqueue Message (Single).gvi"(message queue in=w30, message="NoLoad") -> (message queue out=w33, error out=w32)
        w31 = default
      }
      on "VAC Button" Value changed {
        call "Enqueue Message (Single).gvi"(message queue in=w30, message="VAC", message data=0) -> (message queue out=w33, error out=w32)
        $"VAC Load Counter" <- 0
        w31 = default
      }
    }
    call "Error Handler - Event Handling Loop.gvi"(message queue in=w33, error in=w32) -> (dup error in=w45)
    stop if w31
  }
  # PV-panel type
  # PV-load type
  Unregister For Events(error in=w45, event registration refnum=s2)
  $"API Key" <- "zYUbuW0YNkg1G__lXfJiGVBNWME-HlVd2a5NUHp-IP"
  w46 = cluster{"VISA Resource": "VISA Instr"} {"VISA Resource"="COM5"}
  s3 = "UI Data.gtype" {all zero or empty}  # shift register
  s4 = w46  # shift register
  while {
    call "Dequeue Message.gvi"(message queue in=w30, error in=w29) -> (message queue out=w47, message=w48, message data=w49, error out=w50)
    $"Hardware Status" <- w48
    # s3: Data
    # s4: VISA
    # w26: Stop Event
    case (w48) ignore case {  # Message Cases
      frame "Initialize" {
        $"Arduino Status_2" <- FALSE
        Property Node(instance in=reference to "PV-Lab Status", "ValueSignaling"="Hardware Initializing")
        Flush Queue(error in=w50, queue=w47) -> (error out=w55, queue out=w56)
        call "Enqueue Message (Single).gvi"(message queue in=w56, message="Initialize VISA", error in=w55) -> (message queue out=w57, error out=w58)
        call "Enqueue Message (Single).gvi"(message queue in=w57, message="Set Arduino Status", error in=w58) -> (message queue out=w59, error out=w60)
        call "Enqueue Message (Single).gvi"(message queue in=w59, message="Panel Type Switch", message data="Panel Type 1", error in=w60) -> (message queue out=w61, error out=w62)
        call "Enqueue Message (Single).gvi"(message queue in=w61, message="Load Type Switch", message data="Panel Type 1", error in=w62) -> (message queue out=w63, error out=w64)
        call "Enqueue Message (Single).gvi"(message queue in=w63, message="NoLoad", error in=w64) -> (message queue out=w65, error out=w66)
        call "Enqueue Message (Single).gvi"(message queue in=w65, message="Brightness Config", message data=2, error in=w66) -> (message queue out=w67, error out=w68)
        call "Enqueue Message (Single).gvi"(message queue in=w67, message="Fans Control", message data="0", error in=w68) -> (message queue out=w69, error out=w70)
        call "Enqueue Message (Single).gvi"(message queue in=w69, message="Heat Config", message data="0", error in=w70) -> (message queue out=w71, error out=w72)
        call "Enqueue Message (Single).gvi"(message queue in=w71, message="Optic Filter Config", message data="No Filter", error in=w72) -> (message queue out=w73, error out=w74)
        call "Enqueue Message (Single).gvi"(message queue in=w73, message="IR Thermometer Position", message data="None", error in=w74) -> (message queue out=w75, error out=w76)
        call "Enqueue Message (Single).gvi"(message queue in=w75, message="Set PV Angle", message data=90, error in=w76) -> (message queue out=w77, error out=w78)
        call "Enqueue Message (Single).gvi"(message queue in=w77, message="Panel Config", message data="Parallel 4", error in=w78) -> (message queue out=w79, error out=w80)
        call "Enqueue Message (Single).gvi"(message queue in=w79, message="Wait For Event", error in=w80) -> (error out=w51)
        Build Array(reference to "Arduino Status") -> w81
        for {
          w82 = each element of w81
          Property Node(instance in=w82, "Value"="none")
        }
        Build Array(reference to "TempSensor", reference to "LuxSensor", reference to "Voltage 1", reference to "Current 1") -> w83
        for {
          w84 = each element of w83
          Property Node(instance in=w84, "Value"=-1)
        }
        Property Node(instance in=reference to "Set LoadRTotal", "Value"="")
        Property Node(instance in=reference to "VAC Load Counter", "Value"=0)
        $"Load Reply" <- ""
        w52 = s3
        w53 = default
        w54 = s4
      }
      frame "Initialize VISA" {
        call "Configure Serial Port (Instr).gvi"(session in=$"Arduino COM Port", error in=w50, baud rate=115200) -> (session out=w85, error out=w86)
        call "Open (Instr).gvi"(resource name=w85, error in=w86) -> (session out=w87, error out=w51)
        Property Node(instance in=s4, "VISA Resource"=w87) -> (instance out=w54)
        Wait(time to wait=2000)
        w52 = s3
        w53 = default
      }
      frame "Initialize AI" {
        w51 = w50
        w52 = s3
        w53 = default
        w54 = default
      }
      frame "Wait For Event" {
        Wait(time to wait=100)
        call "Enqueue Message (Single).gvi"(message queue in=w47, message="Watchdog", error in=w50) -> (error out=w51)
        w52 = s3
        w53 = default
        w54 = s4
      }
      frame "Send CMD" {
        Property Node(instance in=s4) -> ("VISA Resource"=w88, instance out=w54)
        call "Enqueue Message (Single).gvi"(message queue in=w47, message="Wait For Event", error in=w50) -> (error out=w89)
        call "VISA WriteRead.gvi"(VISA_IN=w88, CMD=$"Manual Command to Arduino", ERROR_IN=w89) -> (Arduino_Reply=w90, ERROR_OUT=w51)
        Property Node(instance in=w90) -> (instance out=w91)
        $"Arduino Command Reply" <- w91
        w52 = s3
        w53 = default
      }
      frame "Set Arduino Status" {
        Property Node(instance in=s4) -> ("VISA Resource"=w92, instance out=w54)
        call "VISA WriteRead.gvi"(VISA_IN=w92, CMD="@TIME 10 CEPHEI#", ERROR_IN=w50) -> (ERROR_OUT=w51)
        w52 = s3
        w53 = default
      }
      frame "Watchdog" {
        Property Node(instance in=s4) -> ("VISA Resource"=w93, instance out=w54)
        call "VISA WriteRead.gvi"(VISA_IN=w93, CMD="@TIME 10 ?#", ERROR_IN=w50) -> (OUTPUT=w94, Arduino_Reply=w95, ERROR_OUT=w96)
        Property Node(instance in=w95) -> ("DATA"=w97)
        call "VISA Reply Parse.gvi"(string=w97) -> (Reply String=w98)
        Match Pattern(regular expression="CEPHEI", string=w98) -> (match substring=w99)
        Is Equal(x=w99, y="CEPHEI") -> w100
        case (w100) {
          frame False, Default {
            Wait(time to wait=5000)
            Property Node(instance in=reference to "PV-Lab Status", "ValueSignaling"="Hardware OFFLINE")
            Flush Queue(error in=w96, queue=w47) -> (error out=w101, queue out=w102)
            call "Enqueue Message (Single).gvi"(message queue in=w102, message="Initialize", error in=w101) -> (error out=w51)
          }
          frame True {
            # @OK TEMP_24.3750000000 LUX_0 IR_0 DIMMER_2 VOLT1_0.00 VOLTSNT1_-0.00 CURR1_-0.06 POWR1_0.00 VOLT2_0.00 VOLTSNT2_-0.00 CURR2_-0.06 POWR2_0.00
            Property Node(instance in=reference to "PV-Lab Status", "ValueSignaling"="Hardware ONLINE")
            $"TempSensor IR" <- 0
            call "VISA WriteRead.gvi"(VISA_IN=w94, CMD="@WDOG 10 1#", ERROR_IN=w96) -> (Arduino_Reply=w103, ERROR_OUT=w104)
            Property Node(instance in=w103) -> ("DATA"=w105)
            call "Enqueue Message (Single).gvi"(message queue in=w47, message="Wait For Event", error in=w104) -> (error out=w51)
            s5 = w105  # shift register
            while {
              Match Pattern(regular expression=" ", string=s5) -> (after substring=w106, before substring=w107)
              Match Pattern(regular expression="_", string=w107) -> (after substring=w108, before substring=w109)
              Floating Point String To Number(string=w108, use system decimal point (T)=FALSE) -> (number=w110)
              case (w109) {
                frame "", Default { }
                frame "TEMP" {
                  $TempSensor <- w110
                  Property Node(instance in=reference to "PV-Temperature, ºC", "Value"=w110)
                }
                frame "LUX" {
                  $LuxSensor <- w110
                  Property Node(instance in=reference to "PV-LightIntensity, W/m2", "Value"=w110)
                }
                frame "DIMMER" {
                  $Dimmer <- w110
                }
                frame "VOLT1" {
                  $"Voltage 1" <- w110
                  Property Node(instance in=reference to "PV-Voltage, V", "Value"=w110)
                }
                frame "VOLSNT1" {
                  $VOLTShunt1 <- w110
                }
                frame "CURR1" {
                  $"Current 1" <- w110
                  Property Node(instance in=reference to "PV-Current, mA", "Value"=w110)
                }
                frame "POWR1" {
                  $Power1 <- w110
                }
              }
              Is Empty String Or Path(string/path=w106) -> w111
              next s5 = w106
              stop if w111
            }
            sequence {
              frame 0 {
                Property Node(instance in=$"Measured Data", "Voltage, V"=$"Voltage 1", "Current, mA"=$"Current 1", "Luminous Flux, Lux"=$LuxSensor, "Temperature, GradC"=$TempSensor, "Temperature IR, GradC"=0) -> (instance out=w112)
                $"Measured Data" <- w112
                $"Chart Volt" <- $"Voltage 1"
                $"Chart Current" <- $"Current 1"
                $"Chart Lux" <- $LuxSensor
                $"Chart Temperature" <- $TempSensor
                $"Chart Load" <- $"Set Load R"
              }
            }
          }
        }
        $"Arduino Status" <- w98
        $"Arduino Status_2" <- w100
        case ($Button) {
          frame False, Default { }
          frame True {
            $"Load Reply" <- ""
          }
        }
        w52 = s3
        w53 = default
      }
      frame "Panel Config" {
        Variant To Data(error in (no error)=w50, type=string "", variant=w49) -> (data=w113, error out=w114)
        Property Node(instance in=s4) -> ("VISA Resource"=w115, instance out=w54)
        call "Panel Switch.gvi"(VISA_IN=w115, CTRL="Disconnect", ERROR_IN=w114) -> (VISA_OUT=w116, ERROR_OUT=w117)
        case (w113) {
          frame "Single" {
            w120 = ["@DO 17 0#", "@DO 18 1#", "@DO 23 1#", "@DO 24 1#", "@DO 25 1#", "@DO 26 0#", "@DO 27 0#", "@DO 28 0#", "@DO 29 1#", "@DO 30 1#", "@DO 31 1#", "@DO 32 1#", "@DO 33 0#"]
            w121 = ["@DO 54 1#", "@DO 55 1#", "@DO 56 1#", "@DO 57 1#", "@DO 58 1#", "@DO 59 1#", "@DO 60 1#", "@DO 61 1#"]
            # @DO 17 0#
            # @DO 18 1#
            # @DO 23 1#
            # @DO 24 1#
            # @DO 25 1#
            # @DO 26 0#
            # @DO 27 0#
            # @DO 28 0#
            # @DO 29 1#
            # @DO 30 1#
            # @DO 31 1#
            # @DO 32 1#
            # @DO 33 0#
            #
            # 03,08,2020
            # 19:51
            Insert Into Array(inArray=w120, new=w121) -> w122
            call "VISA Multiple Write.gvi"(VISA_IN=w116, ARRAY_IN=w122, ERROR_IN=w117) -> (ERROR_OUT=w118)
            w119 = w113
          }
          frame "Parallel 2" {
            # @DO 17 1#
            # @DO 18 0#
            # @DO 23 1#
            # @DO 24 0#
            # @DO 25 1#
            # @DO 26 1#
            # @DO 27 1#
            # @DO 28 1#
            # @DO 29 1#
            # @DO 30 1#
            # @DO 31 1#
            # @DO 32 1#
            # @DO 33 1#
            #
            # 03.08.2020
            # 19.53
            w123 = ["@DO 17 1#", "@DO 18 0#", "@DO 23 1#", "@DO 24 0#", "@DO 25 1#", "@DO 26 1#", "@DO 27 1#", "@DO 28 1#", "@DO 29 1#", "@DO 30 1#", "@DO 31 1#", "@DO 32 1#", "@DO 33 1#"]
            # Disconnect all Diodes
            w124 = ["@DO 54 1#", "@DO 55 1#", "@DO 56 1#", "@DO 57 1#", "@DO 58 1#", "@DO 59 1#", "@DO 60 1#", "@DO 61 1#"]
            Insert Into Array(inArray=w123, new=w124) -> w125
            call "VISA Multiple Write.gvi"(VISA_IN=w116, ARRAY_IN=w125, ERROR_IN=w117) -> (ERROR_OUT=w118)
            w119 = w113
          }
          frame "Parallel 2 Diode" {
            # @DO 17 1#
            # @DO 18 0#
            # @DO 23 1#
            # @DO 24 0#
            # @DO 25 1#
            # @DO 26 1#
            # @DO 27 1#
            # @DO 28 1#
            # @DO 29 1#
            # @DO 30 1#
            # @DO 31 1#
            # @DO 32 1#
            # @DO 33 1#
            #
            # 03.08.2020
            # 19.54
            w126 = ["@DO 17 1#", "@DO 18 0#", "@DO 23 1#", "@DO 24 0#", "@DO 25 1#", "@DO 26 1#", "@DO 27 1#", "@DO 28 1#", "@DO 29 1#", "@DO 30 1#", "@DO 31 1#", "@DO 32 1#", "@DO 33 1#"]
            # @DO 56 0#
            # @DO 57 0#
            #
            # 19.54
            w127 = ["@DO 54 1#", "@DO 55 1#", "@DO 56 0#", "@DO 57 0#", "@DO 58 1#", "@DO 59 1#", "@DO 60 1#", "@DO 61 1#"]
            Insert Into Array(inArray=w126, new=w127) -> w128
            call "VISA Multiple Write.gvi"(VISA_IN=w116, ARRAY_IN=w128, ERROR_IN=w117) -> (ERROR_OUT=w118)
            w119 = w113
          }
          frame "Series 2" {
            # @DO 17 0#
            # @DO 18 1#
            # @DO 23 1#
            # @DO 24 0#
            # @DO 25 1#
            # @DO 26 1#
            # @DO 27 1#
            # @DO 28 1#
            # @DO 29 0#
            # @DO 30 1#
            # @DO 31 1#
            # @DO 32 0#
            # @DO 33 0#
            #
            # 03.08.2020
            # 19.55
            w129 = ["@DO 17 0#", "@DO 18 1#", "@DO 23 1#", "@DO 24 0#", "@DO 25 1#", "@DO 26 1#", "@DO 27 1#", "@DO 28 1#", "@DO 29 0#", "@DO 30 1#", "@DO 31 1#", "@DO 32 0#", "@DO 33 0#"]
            w130 = ["@DO 54 1#", "@DO 55 1#", "@DO 56 1#", "@DO 57 1#", "@DO 58 1#", "@DO 59 1#", "@DO 60 1#", "@DO 61 1#"]
            Insert Into Array(inArray=w129, new=w130) -> w131
            call "VISA Multiple Write.gvi"(VISA_IN=w116, ARRAY_IN=w131, ERROR_IN=w117) -> (ERROR_OUT=w118)
            w119 = w113
          }
          frame "Series 2 Diode" {
            # @DO 17 0#
            # @DO 18 1#
            # @DO 23 1#
            # @DO 24 0#
            # @DO 25 1#
            # @DO 26 1#
            # @DO 27 1#
            # @DO 28 1#
            # @DO 29 0#
            # @DO 30 1#
            # @DO 31 1#
            # @DO 32 0#
            # @DO 33 0#
            #
            # 03.08.2020
            # 19.57
            w132 = ["@DO 17 0#", "@DO 18 1#", "@DO 23 1#", "@DO 24 0#", "@DO 25 1#", "@DO 26 1#", "@DO 27 1#", "@DO 28 1#", "@DO 29 0#", "@DO 30 1#", "@DO 31 1#", "@DO 32 0#", "@DO 33 0#"]
            # @DO 60 0#
            # @DO 61 0#
            #
            # 03.08.2020
            w133 = ["@DO 54 1#", "@DO 55 1#", "@DO 56 1#", "@DO 57 1#", "@DO 58 1#", "@DO 59 1#", "@DO 60 0#", "@DO 61 0#"]
            Insert Into Array(inArray=w132, new=w133) -> w134
            call "VISA Multiple Write.gvi"(VISA_IN=w116, ARRAY_IN=w134, ERROR_IN=w117) -> (ERROR_OUT=w118)
            w119 = w113
          }
          frame "Parallel 4", Default {
            # @DO 17 1#
            # @DO 18 1#
            # @DO 23 1#
            # @DO 24 1#
            # @DO 25 1#
            # @DO 26 1#
            # @DO 27 1#
            # @DO 28 1#
            # @DO 29 1#
            # @DO 30 1#
            # @DO 31 1#
            # @DO 32 1#
            # @DO 33 1#
            #
            # 03.08.2020
            # 19.59
            w135 = ["@DO 17 1#", "@DO 18 1#", "@DO 23 1#", "@DO 24 1#", "@DO 25 1#", "@DO 26 1#", "@DO 27 1#", "@DO 28 1#", "@DO 29 1#", "@DO 30 1#", "@DO 31 1#", "@DO 32 1#", "@DO 33 1#"]
            w136 = ["@DO 54 1#", "@DO 55 1#", "@DO 56 1#", "@DO 57 1#", "@DO 58 1#", "@DO 59 1#", "@DO 60 1#", "@DO 61 1#"]
            Insert Into Array(inArray=w135, new=w136) -> w137
            call "VISA Multiple Write.gvi"(VISA_IN=w116, ARRAY_IN=w137, ERROR_IN=w117) -> (ERROR_OUT=w118)
            w119 = "Parallel 4"
          }
          frame "Parallel 4 Diode" {
            # @DO 17 1#
            # @DO 18 1#
            # @DO 23 1#
            # @DO 24 1#
            # @DO 25 1#
            # @DO 26 1#
            # @DO 27 1#
            # @DO 28 1#
            # @DO 29 1#
            # @DO 30 1#
            # @DO 31 1#
            # @DO 32 1#
            # @DO 33 1#
            # 03.08.2020
            # 20.00
            w138 = ["@DO 17 1#", "@DO 18 1#", "@DO 23 1#", "@DO 24 1#", "@DO 25 1#", "@DO 26 1#", "@DO 27 1#", "@DO 28 1#", "@DO 29 1#", "@DO 30 1#", "@DO 31 1#", "@DO 32 1#", "@DO 33 1#"]
            # @DO 54 0#
            # @DO 55 0#
            # @DO 56 0#
            # @DO 57 0#
            #
            # 03.08.2020
            # 20.00
            w139 = ["@DO 54 0#", "@DO 55 0#", "@DO 56 0#", "@DO 57 0#", "@DO 58 1#", "@DO 59 1#", "@DO 60 1#", "@DO 61 1#"]
            Insert Into Array(inArray=w138, new=w139) -> w140
            call "VISA Multiple Write.gvi"(VISA_IN=w116, ARRAY_IN=w140, ERROR_IN=w117) -> (ERROR_OUT=w118)
            w119 = w113
          }
          frame "Series 4" {
            # @DO 17 0#
            # @DO 18 1#
            # @DO 23 0#
            # @DO 24 1#
            # @DO 25 1#
            # @DO 26 0#
            # @DO 27 0#
            # @DO 28 0#
            # @DO 29 0#
            # @DO 30 0#
            # @DO 31 0#
            # @DO 32 0#
            # @DO 33 0#
            #
            # 03.08.2020
            # 20.02
            w141 = ["@DO 17 0#", "@DO 18 1#", "@DO 23 0#", "@DO 24 1#", "@DO 25 1#", "@DO 26 0#", "@DO 27 0#", "@DO 28 0#", "@DO 29 0#", "@DO 30 0#", "@DO 31 0#", "@DO 32 0#", "@DO 33 0#"]
            w142 = ["@DO 54 1#", "@DO 55 1#", "@DO 56 1#", "@DO 57 1#", "@DO 58 1#", "@DO 59 1#", "@DO 60 1#", "@DO 61 1#"]
            Insert Into Array(inArray=w141, new=w142) -> w143
            call "VISA Multiple Write.gvi"(VISA_IN=w116, ARRAY_IN=w143, ERROR_IN=w117) -> (ERROR_OUT=w118)
            w119 = w113
          }
          frame "Series 4 Diode" {
            # @DO 17 0#
            # @DO 18 1#
            # @DO 23 0#
            # @DO 24 1#
            # @DO 25 1#
            # @DO 26 0#
            # @DO 27 0#
            # @DO 28 0#
            # @DO 29 0#
            # @DO 30 0#
            # @DO 31 0#
            # @DO 32 0#
            # @DO 33 0#
            #
            # 03.08.2020
            # 20.03
            w144 = ["@DO 17 0#", "@DO 18 1#", "@DO 23 0#", "@DO 24 1#", "@DO 25 1#", "@DO 26 0#", "@DO 27 0#", "@DO 28 0#", "@DO 29 0#", "@DO 30 0#", "@DO 31 0#", "@DO 32 0#", "@DO 33 0#"]
            # @DO 58 0#
            # @DO 59 0#
            # @DO 60 0#
            # @DO 61 0#
            #
            # 03.08.2020
            # 20.04
            w145 = ["@DO 54 1#", "@DO 55 1#", "@DO 56 1#", "@DO 57 1#", "@DO 58 0#", "@DO 59 0#", "@DO 60 0#", "@DO 61 0#"]
            Insert Into Array(inArray=w144, new=w145) -> w146
            call "VISA Multiple Write.gvi"(VISA_IN=w116, ARRAY_IN=w146, ERROR_IN=w117) -> (ERROR_OUT=w118)
            w119 = w113
          }
          frame "Parallel Of Series" {
            # @DO 17 1#
            # @DO 18 1#
            # @DO 23 1#
            # @DO 24 1#
            # @DO 25 1#
            # @DO 26 1#
            # @DO 27 0#
            # @DO 28 1#
            # @DO 29 0#
            # @DO 30 0#
            # @DO 31 1#
            # @DO 32 0#
            # @DO 33 1#
            #
            # 03.08.2020
            # 20.05
            w147 = ["@DO 17 1#", "@DO 18 1#", "@DO 23 1#", "@DO 24 1#", "@DO 25 1#", "@DO 26 1#", "@DO 27 0#", "@DO 28 1#", "@DO 29 0#", "@DO 30 0#", "@DO 31 1#", "@DO 32 0#", "@DO 33 1#"]
            w148 = ["@DO 54 1#", "@DO 55 1#", "@DO 56 1#", "@DO 57 1#", "@DO 58 1#", "@DO 59 1#", "@DO 60 1#", "@DO 61 1#"]
            Insert Into Array(inArray=w147, new=w148) -> w149
            call "VISA Multiple Write.gvi"(VISA_IN=w116, ARRAY_IN=w149, ERROR_IN=w117) -> (ERROR_OUT=w118)
            w119 = w113
          }
          frame "Parallel Of Series Diode" {
            # @DO 17 1#
            # @DO 18 1#
            # @DO 23 1#
            # @DO 24 1#
            # @DO 25 1#
            # @DO 26 1#
            # @DO 27 0#
            # @DO 28 1#
            # @DO 29 0#
            # @DO 30 0#
            # @DO 31 1#
            # @DO 32 0#
            # @DO 33 1#
            #
            # 03.08.2020
            # 20.06
            # @DO 58 0#
            # @DO 59 0#
            # @DO 60 0#
            # @DO 61 0#
            #
            # 03.08.2020
            # 20.097
            w150 = ["@DO 17 1#", "@DO 18 1#", "@DO 23 1#", "@DO 24 1#", "@DO 25 1#", "@DO 26 1#", "@DO 27 0#", "@DO 28 1#", "@DO 29 0#", "@DO 30 0#", "@DO 31 1#", "@DO 32 0#", "@DO 33 1#"]
            w151 = ["@DO 54 1#", "@DO 55 1#", "@DO 56 1#", "@DO 57 1#", "@DO 58 0#", "@DO 59 0#", "@DO 60 0#", "@DO 61 0#"]
            Insert Into Array(inArray=w150, new=w151) -> w152
            call "VISA Multiple Write.gvi"(VISA_IN=w116, ARRAY_IN=w152, ERROR_IN=w117) -> (ERROR_OUT=w118)
            w119 = w113
          }
          frame "Series Of Parallel" {
            w153 = ["@DO 54 1#", "@DO 55 1#", "@DO 56 1#", "@DO 57 1#", "@DO 58 1#", "@DO 59 1#", "@DO 60 1#", "@DO 61 1#"]
            # @DO 17 1#
            # @DO 18 0#
            # @DO 23 0#
            # @DO 24 0#
            # @DO 25 0#
            # @DO 26 1#
            # @DO 27 1#
            # @DO 28 1#
            # @DO 29 1#
            # @DO 30 1#
            # @DO 31 1#
            # @DO 32 1#
            # @DO 33 1#
            #
            # 03.08.2020
            # 20.07
            w154 = ["@DO 17 1#", "@DO 18 0#", "@DO 23 0#", "@DO 24 0#", "@DO 25 0#", "@DO 26 1#", "@DO 27 1#", "@DO 28 1#", "@DO 29 1#", "@DO 30 1#", "@DO 31 1#", "@DO 32 1#", "@DO 33 1#"]
            Insert Into Array(inArray=w154, new=w153) -> w155
            call "VISA Multiple Write.gvi"(VISA_IN=w116, ARRAY_IN=w155, ERROR_IN=w117) -> (ERROR_OUT=w118)
            w119 = w113
          }
          frame "Series Of Parallel Diode" {
            # @DO 17 1#
            # @DO 18 0#
            # @DO 23 0#
            # @DO 24 0#
            # @DO 25 0#
            # @DO 26 1#
            # @DO 27 1#
            # @DO 28 1#
            # @DO 29 1#
            # @DO 30 1#
            # @DO 31 1#
            # @DO 32 1#
            # @DO 33 1#
            #
            # 03.08.2020
            # 20.08
            w156 = ["@DO 17 1#", "@DO 18 0#", "@DO 23 0#", "@DO 24 0#", "@DO 25 0#", "@DO 26 1#", "@DO 27 1#", "@DO 28 1#", "@DO 29 1#", "@DO 30 1#", "@DO 31 1#", "@DO 32 1#", "@DO 33 1#"]
            # @DO 54 0#
            # @DO 55 0#
            # @DO 56 0#
            # @DO 57 0#
            #
            # 20.09
            # 03.08.2020
            w157 = ["@DO 54 0#", "@DO 55 0#", "@DO 56 0#", "@DO 57 0#", "@DO 58 1#", "@DO 59 1#", "@DO 60 1#", "@DO 61 1#"]
            Insert Into Array(inArray=w156, new=w157) -> w158
            call "VISA Multiple Write.gvi"(VISA_IN=w116, ARRAY_IN=w158, ERROR_IN=w117) -> (ERROR_OUT=w118)
            w119 = w113
          }
        }
        Property Node(instance in=reference to "PV-Panel Cofiguration", "ValueSignaling"=w119)
        Property Node(instance in=reference to "Panel Config Selector", "Value"=w119)
        call "Panel Switch.gvi"(VISA_IN=w115, CTRL="Connect", ERROR_IN=w118) -> (ERROR_OUT=w51)
        w52 = s3
        w53 = default
      }
      frame "VAC" {
        w159 = ["0,", "1,", "2,", "3,", "5,", "5,3,", "10,", "20,", "20,10,", "40,", "50,", "50,10,", "50,20,", "50,20,10,", "50,40,", "100,", "100,10,", "100,20,", "100,20,10,", "100,40,", "100,50,10,", "100,50,20,10,", "200,", "200,20,", "200,40,", "200,50,10,", "200,50,20,10,", "200,100,", "200,100,20,5,", "200,100,50,", "200,100,50,20,5,", "400,", "400,20,5,", "400,50,", "500,", "500,50,", "500,100,", "500,100,50,", "500,200,", "500,200,100,", "500,400,", "1000,", "1000,200,", "1000,400,", "1000,500,100,", "1000,500,200,100,", "2000,", "2000,200,50,", "2000,500,", "2000,1000,", "2000,1000,500,", "4000,", "4000,500", "4000,1000,", "4000,2000,", "4000,2000,1000,", "4000,2000,1000,500,400,100,", "NO LOAD"]
        Variant To Data(type=$"VAC measurements", variant=w49) -> (data=w160)
        Array Size(array=w159) -> (size(s)=w161)
        Is Less Or Equal(x=$"VAC Load Counter", y=w161) -> w162
        Is Greater Or Equal(x=w160, y=$"VAC measurements") -> w163
        Not(x=$"VAC Pause") -> w164
        Logical And(w164, w163) -> w165
        Logical And(w165, w162) -> w166
        Not(x=$"VAC Stop") -> w167
        Logical And(w167, w162) -> w168
        case (w166) {
          frame False, Default {
            # Cycle Watchdog<->VAC until Load Array not completed
            case (w168) {
              frame False, Default {
                Flush Queue(error in=w50, queue=w47) -> (error out=w170, queue out=w171)
                # If Load Array completed NO LOAD and return to regular Watchdog
                call "Enqueue Message (Single).gvi"(message queue in=w171, message="NoLoad", error in=w170) -> (message queue out=w172, error out=w173)
                call "Enqueue Message (Single).gvi"(message queue in=w172, message="Watchdog", error in=w173) -> (error out=w51)
                Build Cluster($"VAC Volt", $"VAC Cur") -> w174
                $"I-V Curve (VAC)" <- w174
                $"VAC Stop" <- FALSE
                $"VAC Pause" <- FALSE
                w169 = 0
              }
              frame True {
                Flush Queue(error in=w50, queue=w47) -> (error out=w175, queue out=w176)
                call "Enqueue Message (Single).gvi"(message queue in=w176, message="Watchdog", error in=w175) -> (message queue out=w177, error out=w178)
                # If Load Array not completed cycle Watchdog<>VAC
                Increment(x=w160) -> w179
                call "Enqueue Message (Single).gvi"(message queue in=w177, message="VAC", message data=w179, error in=w178) -> (error out=w51)
                Build Array($"Voltage temp", $"Voltage 1") -> w180
                $"Voltage temp" <- w180
                Build Array($"Current array", $"Current 1") -> w181
                $"Current array" <- w181
                Build Array($"Total Load temp", $"Set Load R") -> w182
                $"Total Load temp" <- w182
                w169 = $"VAC Load Counter"
              }
            }
          }
          frame True {
            Array Index(array=w159) -> (out0[$"VAC Load Counter"]=w183)
            Flush Queue(error in=w50, queue=w47) -> (error out=w184, queue out=w185)
            # Set Load according to the Load Array
            Is Equal(x="NO LOAD", y=w183) -> w186
            case (w186) {
              frame True {
                call "Enqueue Message (Single).gvi"(message queue in=w185, message="NoLoad", error in=w184) -> (message queue out=w188, error out=w187)
              }
              frame False {
                call "Enqueue Message (Single).gvi"(message queue in=w185, message="Set LoadR", message data=w183, error in=w184) -> (message queue out=w188, error out=w187)
              }
            }
            call "Enqueue Message (Single).gvi"(message queue in=w188, message="VAC", message data=0, error in=w187) -> (error out=w51)
            Is Equal(x=$"VAC Load Counter", y=0) -> w189
            case (w189) {
              frame False, Default {
                sequence {
                  frame 0 {
                    call "Mean (DBL).gvi"(x=$"Voltage temp") -> (mean=w190)
                    Build Array($"VAC Volt", w190) -> w191
                    $"VAC Volt" <- w191
                    call "Mean (DBL).gvi"(x=$"Current array") -> (mean=w192)
                    Build Array($"VAC Cur", w192) -> w193
                    $"VAC Cur" <- w193
                    call "Mean (DBL).gvi"(x=$"Total Load temp") -> (mean=w194)
                    Build Array($"VAC Load", w194) -> w195
                    $"VAC Load" <- w195
                  }
                  frame 1 {
                    $"Voltage temp" <- f64[] []
                    $"Current array" <- f64[] []
                    $"Total Load temp" <- f64[] []
                  }
                }
              }
              frame True {
                $"VAC Volt" <- f64[] []
                $"VAC Load" <- f64[] []
                $"VAC Cur" <- f64[] []
                $"Voltage temp" <- f64[] []
                $"Current array" <- f64[] []
                $"Total Load temp" <- f64[] []
              }
            }
            Increment(x=$"VAC Load Counter") -> w169
          }
        }
        $"VAC Load Counter" <- w169
        w52 = s3
        w53 = default
        w54 = s4
      }
      frame "Optic Filter Config" {
        Variant To Data(error in (no error)=w50, type=string "", variant=w49) -> (data=w196, error out=w197)
        case (w196) {
          frame "No Filter", Default {
            w198 = ["@SERV 4 0#", "@SERVH 3 20#", "@SERV 5 0#"]
            w199 = "No Filter"
          }
          frame "Filter Glass" {
            w198 = ["@SERV 4 0#", "@SERV 5 0#", "@SERVH 3 120#"]
            w199 = w196
          }
          frame "Filter Plastic" {
            w198 = ["@SERV 4 0#", "@SERVH 3 20#", "@SERV 5 90#"]
            w199 = w196
          }
        }
        Property Node(instance in=reference to "Optic Filter Selector", "Value"=w199)
        Property Node(instance in=reference to "PV-Optical Filter", "ValueSignaling"=w199)
        Property Node(instance in=s4) -> ("VISA Resource"=w200, instance out=w54)
        call "VISA Multiple Write.gvi"(VISA_IN=w200, ARRAY_IN=w198, ERROR_IN=w197) -> (ERROR_OUT=w51)
        w52 = s3
        w53 = default
      }
      frame "Panel Type Switch" {
        Variant To Data(error in (no error)=w50, type=string "", variant=w49) -> (data=w201, error out=w202)
        case (w201) {
          frame "Panel Type 1", Default {
            w203 = ["@DO 50 1#", "@DO 51 1#"]
            w204 = "Panel type 1"
          }
          frame "Panel Type 2" {
            w203 = ["@DO 50 0#", "@DO 51 0#"]
            w204 = w201
          }
        }
        # PV-panel type
        Property Node(instance in=reference to "Panel Type Config", "Value"=w204)
        Property Node(instance in=s4) -> ("VISA Resource"=w205, instance out=w54)
        call "VISA Multiple Write.gvi"(VISA_IN=w205, ARRAY_IN=w203, ERROR_IN=w202) -> (ERROR_OUT=w51)
        w52 = s3
        w53 = default
      }
      frame "Load Type Switch" {
        Variant To Data(error in (no error)=w50, type=string "", variant=w49) -> (data=w206, error out=w207)
        case (w206) {
          frame "Panel Type 1", Default {
            w208 = ["@DO 52 1#", "@DO 53 1#"]
            w209 = "Load type 1"
          }
          frame "Load Type 2" {
            w208 = ["@DO 52 0#", "@DO 53 0#"]
            w209 = w206
          }
        }
        # PV-load type
        Property Node(instance in=reference to "Load Type Config", "Value"=w209)
        Property Node(instance in=s4) -> ("VISA Resource"=w210, instance out=w54)
        call "VISA Multiple Write.gvi"(VISA_IN=w210, ARRAY_IN=w208, ERROR_IN=w207) -> (ERROR_OUT=w51)
        w52 = s3
        w53 = default
      }
      frame "Fans Control" {
        Variant To Data(error in (no error)=w50, type=string "", variant=w49) -> (data=w211, error out=w212)
        case (w211) {
          frame "0", Default {
            w213 = ["@DO 11 0#", "@DO 12 0#"]
            w214 = "0"
          }
          frame "100" {
            w213 = ["@PWM 11 255#", "@PWM 12 255#"]
            w214 = "100"
          }
          frame "50" {
            w213 = ["@PWM 11 127#", "@PWM 12 127#"]
            w214 = "50"
          }
        }
        Property Node(instance in=reference to "PV-Cooling", "ValueSignaling"=w214)
        Property Node(instance in=reference to "Fans Selector", "Value"=w214)
        Property Node(instance in=s4) -> ("VISA Resource"=w215, instance out=w54)
        call "VISA Multiple Write.gvi"(VISA_IN=w215, ARRAY_IN=w213, ERROR_IN=w212) -> (ERROR_OUT=w51)
        w52 = s3
        w53 = default
      }
      frame "Heat Config" {
        Variant To Data(error in (no error)=w50, type=string "", variant=w49) -> (data=w216, error out=w217)
        case (w216) {
          frame "0", Default {
            w218 = ["@DO 9 0#"]
            w219 = "0"
          }
          frame "50" {
            w218 = ["@PWM 9 125#"]
            w219 = "50"
          }
          frame "100" {
            w218 = ["@PWM 9 255#"]
            w219 = "100"
          }
        }
        Property Node(instance in=reference to "PV-Heating", "ValueSignaling"=w219)
        Property Node(instance in=reference to "Heat Selector", "Value"=w219)
        Property Node(instance in=s4) -> ("VISA Resource"=w220, instance out=w54)
        call "VISA Multiple Write.gvi"(VISA_IN=w220, ARRAY_IN=w218, ERROR_IN=w217) -> (ERROR_OUT=w51)
        w52 = s3
        w53 = default
      }
      frame "Set PV Angle" {
        Variant To Data(error in (no error)=w50, type=u32 0, variant=w49) -> (data=w221, error out=w222)
        # Set angle limits for PV panels
        In Range And Coerce(lower limit=0, upper limit=180, x=w221) -> (coerced(x)=w223)
        Property Node(instance in=reference to "PV-Panel Tilt Angle, º", "ValueSignaling"=w223)
        Property Node(instance in=reference to "PV Angle", "Value"=w223)
        Property Node(instance in=s4) -> ("VISA Resource"=w224, instance out=w54)
        Number To Decimal String(number=w223) -> (decimal integer string=w225)
        Concatenate Strings("@SERV 13 ", w225, "#") -> w226
        call "VISA WriteRead.gvi"(VISA_IN=w224, CMD=w226, ERROR_IN=w222) -> (ERROR_OUT=w51)
        w52 = s3
        w53 = default
      }
      frame "Brightness Config" {
        Variant To Data(error in (no error)=w50, type=u32 0, variant=w49) -> (data=w227, error out=w228)
        # Set brightness limits
        In Range And Coerce(lower limit=2, upper limit=99, x=w227) -> (coerced(x)=w229)
        Property Node(instance in=reference to "Light Power", "Value"=w229)
        Property Node(instance in=s4) -> ("VISA Resource"=w230, instance out=w54)
        Number To Decimal String(number=w229) -> (decimal integer string=w231)
        Concatenate Strings("@DIM 6 ", w231, "#") -> w232
        call "VISA WriteRead.gvi"(VISA_IN=w230, CMD=w232, ERROR_IN=w228) -> (ERROR_OUT=w51)
        w52 = s3
        w53 = default
      }
      frame "IR Thermometer Position" {
        Variant To Data(error in (no error)=w50, type=string "", variant=w49) -> (data=w233, error out=w234)
        case (w233) {
          frame "None", Default {
            w235 = "@SERV 4 0#"
            w236 = w233
          }
          frame "Panel 1" {
            w235 = "@SERV 4 10#"
            w236 = w233
          }
          frame "Panel 2" {
            w235 = "@SERV 4 25#"
            w236 = w233
          }
          frame "Panel 3" {
            w235 = "@SERV 4 110#"
            w236 = w233
          }
          frame "Panel 4" {
            w235 = "@SERV 4 130#"
            w236 = w233
          }
        }
        Property Node(instance in=reference to "IR Thermometer Position Selector", "Value"=w236)
        Property Node(instance in=reference to "PV-Temperature IR Position", "ValueSignaling"=w236)
        Property Node(instance in=s4) -> ("VISA Resource"=w237, instance out=w54)
        call "VISA WriteRead.gvi"(VISA_IN=w237, CMD=w235, ERROR_IN=w234) -> (ERROR_OUT=w51)
        w52 = s3
        w53 = default
      }
      frame "Set LoadR" {
        Property Node(instance in=s4) -> ("VISA Resource"=w238, instance out=w54)
        Variant To Data(error in (no error)=w50, type=string "", variant=w49) -> (data=w239, error out=w240)
        # Disconnect ALL load
        w241 = ["@DO 14 1#", "@DO 34 0#", "@DO 35 0#", "@DO 36 0#", "@DO 37 0#", "@DO 38 0#", "@DO 39 0#", "@DO 40 0#", "@DO 41 0#", "@DO 43 0#", "@DO 44 0#", "@DO 45 0#", "@DO 46 0#", "@DO 47 0#", "@DO 48 0#", "@DO 49 0#", "@DO 42 0#"]
        sequence {
          frame 0 {
            call "VISA Multiple Write.gvi"(VISA_IN=w238, ARRAY_IN=w241, ERROR_IN=w240) -> (VISA_OUT=w242, ERROR_OUT=w243)
            $"Set Load R" <- 1
          }
        }
        s6 = w239  # shift register
        s7 = 0  # shift register
        s8 = ""  # shift register
        while {
          Match Pattern(regular expression=",", string=s6) -> (after substring=w244, before substring=w245)
          case (w245) {
            frame "1" {
              w246 = w245
              w247 = "@DO 43 1#"
            }
            frame "2" {
              w246 = w245
              w247 = "@DO 44 1#"
            }
            frame "3" {
              w246 = w245
              w247 = "@DO 45 1#"
            }
            frame "5" {
              w246 = w245
              w247 = "@DO 46 1#"
            }
            frame "10" {
              w246 = w245
              w247 = "@DO 47 1#"
            }
            frame "20" {
              w246 = w245
              w247 = "@DO 48 1#"
            }
            frame "40" {
              w246 = w245
              w247 = "@DO 49 1#"
            }
            frame "50" {
              w246 = w245
              w247 = "@DO 34 1#"
            }
            frame "100" {
              w246 = w245
              w247 = "@DO 35 1#"
            }
            frame "200" {
              w246 = w245
              w247 = "@DO 36 1#"
            }
            frame "400" {
              w246 = w245
              w247 = "@DO 37 1#"
            }
            frame "500" {
              w246 = w245
              w247 = "@DO 38 1#"
            }
            frame "1000" {
              w246 = w245
              w247 = "@DO 39 1#"
            }
            frame "2000" {
              w246 = w245
              w247 = "@DO 40 1#"
            }
            frame "4000" {
              w246 = w245
              w247 = "@DO 41 1#"
            }
            frame "6500" {
              w246 = w245
              w247 = "@DO 42 1#"
            }
            frame "0", Default {
              w246 = "0"
              w247 = ""
            }
          }
          Decimal String To Number(string=w246) -> (number=w248)
          Add(w248, s7) -> w249
          $"Set Load R" <- w249
          Concatenate Strings(s8, ",", w246) -> w250
          $"Total LoadR_SET" <- w250
          call "VISA WriteRead.gvi"(VISA_IN=w242, CMD=w247, ERROR_IN=w243) -> (Arduino_Reply=w251, ERROR_OUT=w252)
          Property Node(instance in=w251) -> ("Timestamp"=w253, "DATA"=w254)
          Format Date Time String(time format string (%c)="%c", time stamp=w253) -> (date/time string=w255)
          Concatenate Strings(w239, "-----", w255, "-----", w245, "-----", w247, "-----", w254, "\r") -> w256
          Feedback Node(input=w257) -> w258
          Concatenate Strings(w258, w256) -> w257
          $"Load Reply" <- w257
          Is Empty String Or Path(string/path=w244) -> w259
          next s6 = w244
          next s7 = w249
          next s8 = w250
          stop if w259
        }
        # Connect Load
        call "VISA WriteRead.gvi"(VISA_IN=w238, CMD="@DO 14 0#", ERROR_IN=w252) -> (ERROR_OUT=w51)
        sequence {
          frame 0 {
            Wait(time to wait=5000)
          }
        }
        $"Set Load R" <- s7
        Property Node(instance in=reference to "PV-LoadR,Ohm", "ValueSignaling"=s7)
        $"Total LoadR_SET" <- s8
        Property Node(instance in=reference to "PV-LoadRTotal", "ValueSignaling"=s8)
        w52 = s3
        w53 = default
      }
      frame "NoLoad" {
        # Сопротивление в начальное положение
        Property Node(instance in=reference to "PV-LoadRTotal", "ValueSignaling"="Disconnected (NO LOAD)")
        Property Node(instance in=reference to "Set LoadRTotal", "Value"="")
        $"Total LoadR_SET" <- "Disconnected (NO LOAD)"
        Property Node(instance in=reference to "PV-LoadR,Ohm", "ValueSignaling"=-1)
        Property Node(instance in=s4) -> ("VISA Resource"=w260, instance out=w54)
        # Disconnect all Load adn breake circuit
        # NO LOAD
        # Размыкаются всё реле, сопротивление- бесконечность
        w261 = ["@DO 42 1#", "@DO 34 1#", "@DO 35 1#", "@DO 36 1#", "@DO 37 1#", "@DO 38 1#", "@DO 39 1#", "@DO 40 1#", "@DO 41 1#", "@DO 43 1#", "@DO 44 1#", "@DO 45 1#", "@DO 46 1#", "@DO 47 1#", "@DO 48 1#", "@DO 49 1#"]
        call "VISA Multiple Write.gvi"(VISA_IN=w260, ARRAY_IN=w261, ERROR_IN=w50) -> (ERROR_OUT=w51)
        sequence {
          frame 0 {
            Wait(time to wait=7000)
          }
        }
        $"Set Load R" <- -1
        w52 = s3
        w53 = default
      }
      frame "Error" {
        Variant To Data(error in (no error)=w50, type=no error, variant=w49) -> (data=w262, error out=w51)
        # #CodeRecommended - If you ever change the name of this "Error" message, you'll need to update the name in the Check Loop Error.vi as well.
        call "Display Error.gvi"(error in=w262)
        w52 = s3
        w53 = default
        w54 = s4
      }
      frame "Exit" {
        Generate User Event(event data=TRUE, user event=w26) -> (error out=w263)
        Release Queue(error in=w50, queue=w47) -> (error out=w264)
        Property Node(instance in=s4) -> ("VISA Resource"=w265)
        call "Close (Instr).gvi"(session in=w265) -> (error out=w266)
        Merge Errors(w266, w263, w264) -> (error out=w51)
        w52 = s3
        w53 = TRUE
        w54 = default
      }
      frame Default {
        w267 = "The invalid message string \"%s\" was received in the Message Handling Loop."
        Format Into String(formatString=w267, w48) -> w268
        call "Build Error Cluster.gvi"(code=1, description=w268) -> (error out=w51)
        w52 = s3
        w53 = default
        w54 = s4
      }
    }
    call "Error Handler - Message Handling Loop.gvi"(message queue in=w47, error in=w51) -> (dup error in=w269)
    next s3 = w52
    next s4 = w54
    stop if w53
  }
  $"Server URL" <- "https://api.systemlinkcloud.com/"
  $"Exit 2" <- FALSE
  $SendArrayDoubleToCloud <- "Send Measured Data To Cloud"
  $SendStringToCloud <- "Send String To Cloud"
  $SendDoubleToCloud <- "Send Double To Cloud"
  w270 = bool FALSE  # Stop Event
  Create User Event[EventName="Stop Event"](user event data type=w270) -> (error out=w271, user event out=w272)
  call "Create All Message Queues.gvi"(error in=w271) -> (message queues=w273, error out=w274)
  Property Node(instance in=w273) -> ("UI"=w275)
  s9 = "UI Data.gtype" {all zero or empty}  # shift register
  while {
    call "Dequeue Message.gvi"(message queue in=w275, error in=w274) -> (message queue out=w276, message=w277, message data=w278, error out=w279)
    # s9: Data
    # w272: Stop Event
    case (w277) ignore case {  # Message Cases
      frame "Initialize" {
        Property Node(instance in=s9, "String"=w277) -> (instance out=w281)
        call "Enqueue Message (Single).gvi"(message queue in=w276, message="Update Display", message data=w277, error in=w279) -> (message queue out=w283, error out=w284)
        # Bundle a sample string value.
        call "Enqueue Message (Single).gvi"(message queue in=w283, message=$SendArrayDoubleToCloud, error in=w284) -> (error out=w280)
        Property Node(instance in=reference to "PV-Temperature, ºC", "ValueSignaling"=0)
        Property Node(instance in=reference to "MV-Panel Configuration", "Value"="none")
        Property Node(instance in=reference to "PV-Panel Cofiguration", "ValueSignaling"="none")
        Property Node(instance in=reference to "MV-Heating", "Value"="none")
        Property Node(instance in=reference to "PV-Temperature IR, ºC", "ValueSignaling"=0)
        Property Node(instance in=reference to "PV-Heating", "ValueSignaling"="none")
        Property Node(instance in=reference to "MV-Cooling", "Value"="none")
        Property Node(instance in=reference to "PV-LightIntensity, W/m2", "ValueSignaling"=0)
        Property Node(instance in=reference to "PV-Cooling", "ValueSignaling"="none")
        Property Node(instance in=reference to "MV-Light Power", "Value"="none")
        Property Node(instance in=reference to "PV-Panel Tilt Angle, º", "ValueSignaling"=0)
        Property Node(instance in=reference to "PV-Optical Filter", "ValueSignaling"="none")
        Property Node(instance in=reference to "MV-Optical Filter", "Value"="none")
        Property Node(instance in=reference to "PV-LigthPower, %", "ValueSignaling"=0)
        Property Node(instance in=reference to "PV-LoadR4", "ValueSignaling"="none")
        Property Node(instance in=reference to "MV-Panel Tilt Angle", "Value"="none")
        Property Node(instance in=reference to "PV-Voltage, V", "ValueSignaling"=0)
        Property Node(instance in=reference to "PV-LoadR3", "ValueSignaling"="none")
        Property Node(instance in=reference to "MV-LoadR1", "Value"="none")
        Property Node(instance in=reference to "PV-LoadR2", "ValueSignaling"="none")
        Property Node(instance in=reference to "PV-Current, mA", "ValueSignaling"=0)
        Property Node(instance in=reference to "MV-LoadR2", "Value"="none")
        Property Node(instance in=reference to "PV-LoadR1", "ValueSignaling"="none")
        Property Node(instance in=reference to "PV-LoadR,Ohm", "ValueSignaling"=0)
        Property Node(instance in=reference to "MV-LoadR3", "Value"="none")
        Property Node(instance in=reference to "PV-LoadRTotal", "ValueSignaling"="none")
        Property Node(instance in=reference to "MV-LoadR4", "Value"="none")
        Property Node(instance in=reference to "MV-LoadRTotal", "Value"="none")
        w282 = default
      }
      frame "Something" {
        # #CodeNeeded - Perform whatever actions correspond to the "Something" message.
        # Send string to "Update Display" message
        call "Enqueue Message (Single).gvi"(message queue in=w276, message="Update Display", message data="\"Do Something\" button pressed", error in=w279) -> (error out=w280)
        w281 = s9
        w282 = default
      }
      frame "Something Else" {
        # #CodeNeeded - Perform whatever actions correspond to the "Something Else" message.
        # Send string to "Update Display" message
        call "Enqueue Message (Single).gvi"(message queue in=w276, message="Update Display", message data="\"Do Something Else\" button pressed", error in=w279) -> (error out=w280)
        w281 = s9
        w282 = default
      }
      frame "Update Display" {
        # #CodeRecommended - If you wish to decouple the Message Handling Loop from your user interface, consider creating User Events (like the "Stop" event in this VI) to message the Event Handling Loop whenever the user interface needs updating.
        Variant To Data(error in (no error)=w279, type=string "", variant=w278) -> (data=w285, error out=w280)
        $"Status of Send to SystemLink Cycle" <- w285
        w281 = s9
        w282 = default
      }
      frame "Error" {
        Variant To Data(error in (no error)=w279, type=no error, variant=w278) -> (data=w286, error out=w280)
        # #CodeRecommended - Consider creating a system for logging errors in some way. These errors are for notification purposes only. Handling of specific errors should be performed in the message frames that generated the error.
        # #CodeRecommended - If you ever change the name of this "Error" message, you'll need to update the name in the Check Loop Error.vi as well.
        call "Display Error.gvi"(error in=w286)
        w281 = s9
        w282 = default
      }
      frame "---Copy This Frame---" {
        Merge Errors(w279) -> (error out=w280)
        w281 = s9
        w282 = default
      }
      frame "Exit" {
        # Release the message queue reference
        Release Queue(error in=w279, queue=w276) -> (error out=w287)
        # #CodeNeeded - Add any required cleanup code here. Note that if 'Exit' was called as a result of an error, an error dialog will be displayed. Add any custom error handling for an 'Exit' condition here as well.
        Generate User Event(event data=TRUE, user event=w272) -> (error out=w288)
        Merge Errors(w288, w287) -> (error out=w280)
        # Stop the VI
        $"Exit 2" <- TRUE
        w281 = s9
        w282 = TRUE
      }
      frame Default {
        w289 = "The invalid message string \"%s\" was received in the Message Handling Loop."
        Format Into String(formatString=w289, w277) -> w290
        call "Build Error Cluster.gvi"(code=1, description=w290) -> (error out=w280)
        w281 = s9
        w282 = default
      }
      frame "Send Double To Cloud" {
        Property Node(instance in=s9, "String"=w277) -> (instance out=w281)
        call "Open Configuration API Key.gvi"(server url=$"Server URL", api key=$"API Key", error in=w279) -> (configuration=w291)
        Variant To Data(type=string[] [], variant=w278) -> (data=w292)
        Array Index(array=w292) -> (out0[0]=w293, out1[1]=w294)
        Floating Point String To Number(string=w294) -> (number=w295)
        Build Array(w293) -> w296
        call "Query Tags.gvi"(paths=w296, configuration=w291) -> (tags=w297, error out=w298)
        Array Index(array=w297) -> (out0[_]=w299)
        Property Node(instance in=w299) -> ("Path"=w300, "Datatype"=w301)
        call "Open Tag.gvi"(path=w300, data type=w301, error in=w298, configuration=w291) -> (tag=w302, error out=w303)
        call "Write Tag (DBL).gvi"(tag in=w302, value=w295, error in=w303) -> (tag out=w304, error out=w305)
        call "Close Tag (Single).gvi"(tag=w304, error in=w305) -> (error out=w306)
        call "Close Configuration.gvi"(configuration=w291, error in=w306) -> (error out=w280)
        call "Enqueue Message (Single).gvi"(message queue in=w276, message="Update Display", message data=w277)
        w282 = default
      }
      frame "Send Measured Data To Cloud" {
        Property Node(instance in=s9, "String"=w277) -> (instance out=w281)
        call "Enqueue Message (Single).gvi"(message queue in=w276, message="Update Display", message data=w277, error in=w279) -> (message queue out=w307, error out=w308)
        call "Enqueue Message (Single).gvi"(message queue in=w307, message=$SendArrayDoubleToCloud, error in=w308) -> (error out=w309)
        call "Open Configuration API Key.gvi"(server url=$"Server URL", api key=$"API Key", error in=w309) -> (configuration=w310, error out=w311)
        w312 = ["PV-Current", "PV-Voltage", "PV-LigthtIntensity", "PV-Temperature"]
        call "Query Tags.gvi"(paths=w312, error in=w311, configuration=w310) -> (tags=w313, error out=w314)
        Property Node(instance in=$"Measured Data") -> ("Voltage, V"=w315, "Current, mA"=w316, "Luminous Flux, Lux"=w317, "Temperature, GradC"=w318)
        Build Array(w315, w316, w317, w318) -> w319
        for {
          w320 = each element of w313
          w321 = each element of w319
          Property Node(instance in=w320) -> ("Path"=w322, "Datatype"=w323)
          call "Open Tag.gvi"(path=w322, data type=w323, error in=w314, configuration=w310) -> (tag=w324, error out=w325)
          call "Write Tag (DBL).gvi"(tag in=w324, value=w321, error in=w325) -> (error out=w326)
        }
        for {
          w327 = each element of w313
          call "Close Tag (Single).gvi"(tag=w327, error in=w326) -> (error out=w328)
        }
        call "Close Configuration.gvi"(configuration=w310, error in=w328) -> (error out=w280)
        w282 = default
      }
      frame "Send String To Cloud" {
        Property Node(instance in=s9, "String"=w277) -> (instance out=w281)
        call "Open Configuration API Key.gvi"(server url=$"Server URL", api key=$"API Key", error in=w279) -> (configuration=w329, error out=w330)
        Variant To Data(type=string[] [], variant=w278) -> (data=w331)
        Array Index(array=w331) -> (out0[0]=w332, out1[1]=w333)
        Build Array(w332) -> w334
        call "Query Tags.gvi"(paths=w334, configuration=w329) -> (tags=w335)
        Array Index(array=w335) -> (out0[_]=w336)
        Property Node(instance in=w336) -> ("Path"=w337, "Datatype"=w338)
        call "Open Tag.gvi"(path=w337, data type=w338, error in=w330, configuration=w329) -> (tag=w339, error out=w340)
        call "Write Tag (String).gvi"(tag in=w339, value=w333, error in=w340) -> (tag out=w341, error out=w342)
        call "Close Tag (Single).gvi"(tag=w341, error in=w342) -> (error out=w343)
        call "Close Configuration.gvi"(configuration=w329, error in=w343) -> (error out=w280)
        call "Enqueue Message (Single).gvi"(message queue in=w276, message="Update Display", message data=w277)
        w282 = default
      }
    }
    call "Error Handler - Message Handling Loop.gvi"(message queue in=w276, error in=w280) -> (dup error in=w344)
    next s9 = w281
    stop if w282
  }
  Register For Events("Stop Event"=w272) -> (event registration refnum out=w345)
  s10 = w345  # shift register
  while {
    event (dynamic events = s10) {
      on "Do Something" Value changed {
        # #CodeNeeded - Send the appropriate message for this user interface event.
        call "Enqueue Message (Single).gvi"(message queue in=w275, message="Something") -> (message queue out=w348, error out=w347)
        w346 = default
      }
      on "Do Something Else" Value changed {
        # #CodeNeeded - Send the appropriate message for this user interface event.
        call "Enqueue Message (Single).gvi"(message queue in=w275, message="Something Else") -> (message queue out=w348, error out=w347)
        w346 = default
      }
      on "Exit" Value changed {
        call "Enqueue Message (Single).gvi"(priority message=TRUE, message queue in=w275, message="Exit") -> (message queue out=w348, error out=w347)
        w346 = default
      }
      on dynamic event 0 {
        # The Message Handling Loop processed an "Exit" message, which fired this event to stop the Event Handling Loop.
        $"Status of Send to SystemLink Cycle" <- "\"Exit\" button pressed"
        w346 = TRUE
        w347 = default
        w348 = w275
      }
      on "Window" Close? {
        call "Enqueue Message (Single).gvi"(priority message=TRUE, message queue in=w275, message="Exit") -> (message queue out=w348)
        Event Filter("Discard?"=TRUE)
        w346 = default
        w347 = default
      }
      on "PV-Current, mA" Value changed {
        Event Data() -> ("New Value"=w349)
        Number To Fractional String(number=w349) -> (F-format string=w350)
        Build Array("PV-Current", w350) -> w351
        call "Enqueue Message (Single).gvi"(message queue in=w275, message=$SendDoubleToCloud, message data=w351) -> (message queue out=w348, error out=w347)
        w346 = default
      }
      on "PV-LoadR,Ohm" Value changed {
        Event Data() -> ("New Value"=w352)
        Number To Fractional String(number=w352) -> (F-format string=w353)
        Build Array("PV-LoadR", w353) -> w354
        call "Enqueue Message (Single).gvi"(message queue in=w275, message=$SendDoubleToCloud, message data=w354) -> (message queue out=w348, error out=w347)
        w346 = default
      }
      on "PV-Voltage, V" Value changed {
        Event Data() -> ("New Value"=w355)
        Number To Fractional String(number=w355) -> (F-format string=w356)
        Build Array("PV-Voltage", w356) -> w357
        call "Enqueue Message (Single).gvi"(message queue in=w275, message=$SendDoubleToCloud, message data=w357) -> (message queue out=w348, error out=w347)
        w346 = default
      }
      on "PV-Temperature, ºC" Value changed {
        Event Data() -> ("New Value"=w358)
        Number To Fractional String(number=w358) -> (F-format string=w359)
        Build Array("PV-Temperature", w359) -> w360
        call "Enqueue Message (Single).gvi"(message queue in=w275, message=$SendDoubleToCloud, message data=w360) -> (message queue out=w348, error out=w347)
        w346 = default
      }
      on "PV-Temperature IR, ºC" Value changed {
        Event Data() -> ("New Value"=w361)
        Number To Fractional String(number=w361) -> (F-format string=w362)
        Build Array("PV-Temperature IR", w362) -> w363
        call "Enqueue Message (Single).gvi"(message queue in=w275, message=$SendDoubleToCloud, message data=w363) -> (message queue out=w348, error out=w347)
        w346 = default
      }
      on "PV-LightIntensity, W/m2" Value changed {
        Event Data() -> ("New Value"=w364)
        Number To Fractional String(number=w364) -> (F-format string=w365)
        Build Array("PV-LigthtIntensity", w365) -> w366
        call "Enqueue Message (Single).gvi"(message queue in=w275, message=$SendDoubleToCloud, message data=w366) -> (message queue out=w348, error out=w347)
        w346 = default
      }
      on "PV-LigthPower, %" Value changed {
        Event Data() -> ("New Value"=w367)
        Number To Fractional String(number=w367) -> (F-format string=w368)
        Build Array("PV-LigthtPower", w368) -> w369
        call "Enqueue Message (Single).gvi"(message queue in=w275, message=$SendDoubleToCloud, message data=w369) -> (message queue out=w348, error out=w347)
        w346 = default
      }
      on "PV-Panel Tilt Angle, º" Value changed {
        Event Data() -> ("New Value"=w370)
        Number To Fractional String(number=w370) -> (F-format string=w371)
        Build Array("PV-Panel Tilt Angle", w371) -> w372
        call "Enqueue Message (Single).gvi"(message queue in=w275, message=$SendDoubleToCloud, message data=w372) -> (message queue out=w348, error out=w347)
        w346 = default
      }
      on "PV-Panel Cofiguration" Value changed {
        Event Data() -> ("New Value"=w373)
        Build Array("PV-Panel Configuration", w373) -> w374
        call "Enqueue Message (Single).gvi"(message queue in=w275, message=$SendStringToCloud, message data=w374) -> (message queue out=w348, error out=w347)
        w346 = default
      }
      on "PV-Temperature IR Position" Value changed {
        Event Data() -> ("New Value"=w375)
        Build Array("PV-Temperature IR Position", w375) -> w376
        call "Enqueue Message (Single).gvi"(message queue in=w275, message=$SendStringToCloud, message data=w376) -> (message queue out=w348, error out=w347)
        w346 = default
      }
      on "PV-Cooling" Value changed {
        Event Data() -> ("New Value"=w377)
        Build Array("PV-Cooling", w377) -> w378
        call "Enqueue Message (Single).gvi"(message queue in=w275, message=$SendStringToCloud, message data=w378) -> (message queue out=w348, error out=w347)
        w346 = default
      }
      on "PV-Heating" Value changed {
        Event Data() -> ("New Value"=w379)
        Build Array("PV-Heating", w379) -> w380
        call "Enqueue Message (Single).gvi"(message queue in=w275, message=$SendStringToCloud, message data=w380) -> (message queue out=w348, error out=w347)
        w346 = default
      }
      on "PV-Optical Filter" Value changed {
        Event Data() -> ("New Value"=w381)
        Build Array("PV-Optical Filter", w381) -> w382
        call "Enqueue Message (Single).gvi"(message queue in=w275, message=$SendStringToCloud, message data=w382) -> (message queue out=w348, error out=w347)
        w346 = default
      }
      on "PV-LoadR1" Value changed {
        Event Data() -> ("New Value"=w383)
        Build Array("PV-LoadR1", w383) -> w384
        call "Enqueue Message (Single).gvi"(message queue in=w275, message=$SendStringToCloud, message data=w384) -> (message queue out=w348)
        w346 = default
        w347 = default
      }
      on "PV-LoadR2" Value changed {
        Event Data() -> ("New Value"=w385)
        Build Array("PV-LoadR2", w385) -> w386
        call "Enqueue Message (Single).gvi"(message queue in=w275, message=$SendStringToCloud, message data=w386) -> (message queue out=w348)
        w346 = default
        w347 = default
      }
      on "PV-LoadR3" Value changed {
        Event Data() -> ("New Value"=w387)
        Build Array("PV-LoadR3", w387) -> w388
        call "Enqueue Message (Single).gvi"(message queue in=w275, message=$SendStringToCloud, message data=w388) -> (message queue out=w348)
        w346 = default
        w347 = default
      }
      on "PV-LoadR4" Value changed {
        Event Data() -> ("New Value"=w389)
        Build Array("PV-LoadR4", w389) -> w390
        call "Enqueue Message (Single).gvi"(message queue in=w275, message=$SendStringToCloud, message data=w390) -> (message queue out=w348)
        w346 = default
        w347 = default
      }
      on "PV-LoadRTotal" Value changed {
        Event Data() -> ("New Value"=w391)
        Build Array("PV-LoadRTotal", w391) -> w392
        call "Enqueue Message (Single).gvi"(message queue in=w275, message=$SendStringToCloud, message data=w392) -> (message queue out=w348)
        w346 = default
        w347 = default
      }
      on "PV-Lab Status" Value changed {
        Event Data() -> ("New Value"=w393)
        Build Array("PV-LoadR4", w393) -> w394
        call "Enqueue Message (Single).gvi"(message queue in=w275, message=$SendStringToCloud, message data=w394) -> (message queue out=w348)
        w346 = default
        w347 = default
      }
    }
    call "Error Handler - Event Handling Loop.gvi"(message queue in=w348, error in=w347) -> (dup error in=w395)
    stop if w346
  }
  Unregister For Events(error in=w395, event registration refnum=s10) -> (error out=w396)
  Merge Errors(w396, w344) -> (error out=w397)
  Destroy User Event(error in=w397, user event=w272)
  disable {
    frame Enabled { }
    frame Disabled {
      call "Initialize.gvi"(device name="cam0") -> (session out=w398, error out=w399)
      call "Configure Grab.gvi"(session in=w398, error in=w399) -> (session out=w400, error out=w401)
      call "Create Image.gvi"(image name="image_1") -> (new image=w402)
      while {
        call "Grab.gvi"(session in=w400, error in=w401, image in=w402) -> (session out=w403, error out=w404)
        stop if _
      }
      call "Close.gvi"(session=w403, error in=w404)
    }
  }
