vi "Main.gvi"   [LabVIEW NXG 5.0.0]
# This template is for the Queued Message Handler design pattern.
# The Event Handling Loop generates messages based on user interface actions.
# The Message Handling Loop processes messages generated by the Event Handling Loop, or by other messages.  The messages are string values, so new messages can be added easily to the Message Cases case structure in the Message Handling Loop.  Each message cluster can also provide an optional value for Message Data, which is a variant that can be converted to whatever message-specific data is required.
panel controls:
  "Exit": bool
  "TEMP Button": bool
  "LUX Button": bool
  "VISA Resource Name": "VISA Instr" = "COM5"
  "Initialize VISA": bool
  "CMD Button": bool
  "Initialize AI": bool
  "PV Config Button": bool
  "Set PV Angle Button": bool
  "IR Thermometer Config Button": bool
  "Fans Button": bool
  "Brightness Config Button": bool
  "Optic Filter Config Button": bool
  "Reset CVM Button": bool
  "Stop": bool
  "PV Config Selector": string
  "PV Angle": i32
  "Fans Selector": string
  "Optic Filter Selector": string
  "IR Thermometer Selector": string
  "Brightness": i32
  "Prepare CVM Button": bool
  "write buffer": string = "@DO 34 0#"
  "Set Resistance Button": bool
  "Reset Resistance Button": bool
  "Resistance String": string
  "VAC Button": bool
  "Heat Selector": string
  "Heat Button": bool
panel indicators:
  "Display": string
  "CMD": "TAG.gtype"
  "LUX_2": "TAG.gtype"
  "TEMP_2": "TAG.gtype"
  "Chart": waveform<f64>[]
  "Maсhine State": string
  "Image": "Vision IMAQImage"
  "Voltage Range": f64
  "Voltage coeff": f64
  "Current coeff": f64
  "V_real": f64
  "Current_real": f64
  "VAC Load Counter": i32
  "Voltage_Graph": f64[]
  "Output": error
  "VISA Answer_2": "TAG.gtype"[]
  "VISA Answer": "TAG.gtype"[]
  "Current_Graph": f64[]
  "Graph_3": cluster{"Element 1": f64[], "Element 2": f64[]}
  "Server Url": string
  "Api Key": string
  "Status PV Config": string
  "PV-Connecting Solar Panels": string
types:
  "TAG.gtype" = cluster{"Timestamp": timestamp, "DATA": string}
  "DataType.gtype" = enum{"Double", "I32", "String", "Boolean", "U64", "Timestamp"}
  "Tag.gtype" = cluster{"Path": string, "Datatype": "DataType.gtype", "Configuration": "Configuration.gtype"}
  "Client Handle.gtype" = u32
  "Configuration.gtype" = cluster{"Server URL": string, "Session": "Client Handle.gtype", "Raw Session Queue": Queue<"Client Handle.gtype">}
  T1 = cluster{"VISA Resource": "VISA Instr", "Physical Channel": "DAQmx Task", "tag": "Tag.gtype", "configuration": "Configuration.gtype"}
  "UI Data.gtype" = cluster{"Boolean <Replace Me>": bool, "String <Replace Me>": string, "Numeric <Replace Me>": f64}
  "ValueRange.gtype" = cluster{"maximum value": f64, "minimum value": f64}
uses:
  Message Queue::Create All Message Queues.gvi
  Message Queue::Enqueue Message (Single).gvi
  Support::Error Handler - Event Handling Loop.gvi
  Message Queue::Dequeue Message.gvi
  NI::VISA::Configure Serial Port (Instr).gvi
  NI::VISA::Open (Instr).gvi
  NI::Skyline::Configuration::Open Configuration API Key.gvi
  NI::Skyline::TagHTTP::Open Tag.gvi
  NI::DAQmx::Internal::DAQmx Create Channel (AI-Voltage-Basic).gvi
  Queued Message Handler::Read_Write_VISA.gvi
  Queued Message Handler::PV_switch.gvi
  Queued Message Handler::CMD_Iteration.gvi
  NI::DAQmx::Internal::DAQmx Read (Analog 2D DBL NChan NSamp).gvi
  NI::DAQmx::Internal::DAQmx Read (Analog 1D Wfm NChan NSamp).gvi
  NI::G Core::Error::Display Error.gvi
  NI::Skyline::Configuration::Close Configuration.gvi
  NI::Skyline::TagHTTP::Close Tag (Single).gvi
  NI::DAQmx::Internal::DAQmx Stop Task.gvi
  NI::VISA::Close (Instr).gvi
  NI::G Core::Error::Build Error Cluster.gvi
  Support::Error Handler - Message Handling Loop.gvi
  NI::Vision::IMAQdx::Initialize.gvi
  NI::Vision::IMAQdx::Configure Grab.gvi
  NI::Vision::Core::Basics::Create Image.gvi
  NI::Vision::IMAQdx::Grab.gvi
  NI::Vision::IMAQdx::Close.gvi
diagram:
  $"Server Url" <- "https://api.systemlinkcloud.com/"
  $"PV-Connecting Solar Panels" <- ""
  $"Api Key" <- "zYUbuW0YNkg1G__lXfJiGVBNWME-HlVd2a5NUHp-IP"
  disable {
    frame Enabled { }
    frame Disabled {
      Destroy User Event()
    }
  }
  w1 = bool FALSE  # Stop Event
  Create User Event[EventName="Stop Event"](user event data type=w1) -> (error out=w2, user event out=w3)
  Register For Events("Stop Event"=w3) -> (event registration refnum out=w4)
  call "Create All Message Queues.gvi"(error in=w2) -> (message queues=w5, error out=w6)
  Property Node(instance in=w5) -> ("UI"=w7)
  s1 = w4  # shift register
  while {
    event (dynamic events = s1) {
      on "TEMP Button" Value changed {
        call "Enqueue Message (Single).gvi"(message queue in=w7, message="Get Temperature") -> (message queue out=w10, error out=w9)
        w8 = default
      }
      on "LUX Button" Value changed {
        call "Enqueue Message (Single).gvi"(message queue in=w7, message="Get Brightness") -> (message queue out=w10, error out=w9)
        w8 = default
      }
      on "Exit" Value changed {
        call "Enqueue Message (Single).gvi"(priority message=TRUE, message queue in=w7, message="Exit") -> (message queue out=w10, error out=w9)
        w8 = default
      }
      on dynamic event 0 {
        $Display <- "\"Exit\" button pressed"
        w8 = TRUE
        w9 = default
        w10 = w7
      }
      on "Window" Close? {
        call "Enqueue Message (Single).gvi"(priority message=TRUE, message queue in=w7, message="Exit") -> (message queue out=w10)
        Event Filter("Discard?"=TRUE)
        w8 = default
        w9 = default
      }
      on "Initialize VISA" Value changed {
        call "Enqueue Message (Single).gvi"(message queue in=w7, message="Initialize VISA") -> (message queue out=w10, error out=w9)
        w8 = default
      }
      on "CMD Button" Value changed {
        call "Enqueue Message (Single).gvi"(message queue in=w7, message="Send CMD") -> (message queue out=w10, error out=w9)
        w8 = default
      }
      on "Reset CVM Button" Value changed {
        call "Enqueue Message (Single).gvi"(message queue in=w7, message="Reset CVM") -> (message queue out=w10, error out=w9)
        w8 = default
      }
      on "Initialize AI" Value changed {
        call "Enqueue Message (Single).gvi"(message queue in=w7, message="Initialize AI") -> (message queue out=w10, error out=w9)
        w8 = default
      }
      on "PV Config Button" Value changed {
        call "Enqueue Message (Single).gvi"(message queue in=w7, message="PV Config", message data=$"PV Config Selector") -> (message queue out=w10, error out=w9)
        w8 = default
      }
      on "Heat Button" Value changed {
        call "Enqueue Message (Single).gvi"(message queue in=w7, message="Heat Config", message data=$"Heat Selector") -> (message queue out=w10, error out=w9)
        w8 = default
      }
      on "Set PV Angle Button" Value changed {
        call "Enqueue Message (Single).gvi"(message queue in=w7, message="Set PV Angle", message data=$"PV Angle") -> (message queue out=w10, error out=w9)
        w8 = default
      }
      on "IR Thermometer Config Button" Value changed {
        call "Enqueue Message (Single).gvi"(message queue in=w7, message="IR Thermometer", message data=$"IR Thermometer Selector") -> (message queue out=w10, error out=w9)
        w8 = default
      }
      on "Fans Button" Value changed {
        call "Enqueue Message (Single).gvi"(message queue in=w7, message="Fans Control", message data=$"Fans Selector") -> (message queue out=w10, error out=w9)
        w8 = default
      }
      on "Brightness Config Button" Value changed {
        call "Enqueue Message (Single).gvi"(message queue in=w7, message="Brightness Config", message data=$Brightness) -> (message queue out=w10, error out=w9)
        w8 = default
      }
      on "Optic Filter Config Button" Value changed {
        call "Enqueue Message (Single).gvi"(message queue in=w7, message="Optic Filter Config", message data=$"Optic Filter Selector") -> (message queue out=w10, error out=w9)
        w8 = default
      }
      on "Prepare CVM Button" Value changed {
        call "Enqueue Message (Single).gvi"(message queue in=w7, message="Prepare CVM") -> (message queue out=w10, error out=w9)
        w8 = default
      }
      on "Set Resistance Button" Value changed {
        call "Enqueue Message (Single).gvi"(message queue in=w7, message="Set Resistance", message data=$"Resistance String") -> (message queue out=w10, error out=w9)
        w8 = default
      }
      on "Reset Resistance Button" Value changed {
        call "Enqueue Message (Single).gvi"(message queue in=w7, message="Reset Resistance") -> (message queue out=w10, error out=w9)
        w8 = default
      }
      on "VAC Button" Value changed {
        Property Node(instance in=reference to "Graph_3")
        Get Current Time() -> (current time=w11)
        call "Enqueue Message (Single).gvi"(message queue in=w7, message="VAC", message data=w11) -> (message queue out=w10)
        $"VAC Load Counter" <- 0
        w8 = default
        w9 = default
      }
    }
    call "Error Handler - Event Handling Loop.gvi"(message queue in=w10, error in=w9) -> (dup error in=w12)
    stop if w8
  }
  Unregister For Events(error in=w12, event registration refnum=s1)
  w13 = T1 {"VISA Resource"="COM5", "Physical Channel"="", "tag"={"Path"="", "Datatype"="Double", "Configuration"={"Server URL"="", "Session"=0, "Raw Session Queue"=refnum}}, "configuration"={"Server URL"="", "Session"=0, "Raw Session Queue"=refnum}}
  s2 = "UI Data.gtype" {all zero or empty}  # shift register
  s3 = w13  # shift register
  while {
    call "Dequeue Message.gvi"(message queue in=w7, error in=w6) -> (message queue out=w14, message=w15, message data=w16, error out=w17)
    $"Maсhine State" <- w15
    # s2: Data
    # w3: Stop Event
    case (w15) ignore case {  # Message Cases
      frame "Initialize" {
        # set time
        #
        # NO initialase SLC
        call "Enqueue Message (Single).gvi"(message queue in=w14, message="Initialize VISA", error in=w17) -> (message queue out=w22, error out=w23)
        call "Enqueue Message (Single).gvi"(message queue in=w22, message="Initialize AI", error in=w23) -> (message queue out=w24, error out=w25)
        call "Enqueue Message (Single).gvi"(message queue in=w24, message="Reset CVM", error in=w25) -> (message queue out=w26, error out=w27)
        call "Enqueue Message (Single).gvi"(message queue in=w26, message="Fans Control", message data="Turn All Off", error in=w27) -> (message queue out=w28, error out=w29)
        call "Enqueue Message (Single).gvi"(message queue in=w28, message="Heat Config", message data="No Heat", error in=w29) -> (message queue out=w30, error out=w31)
        call "Enqueue Message (Single).gvi"(message queue in=w30, message="Optic Filter Config", message data="None", error in=w31) -> (message queue out=w32, error out=w33)
        call "Enqueue Message (Single).gvi"(message queue in=w32, message="Set PV Angle", message data=90, error in=w33) -> (message queue out=w34, error out=w35)
        call "Enqueue Message (Single).gvi"(message queue in=w34, message="PV Config", message data="Parallel 4", error in=w35) -> (message queue out=w36, error out=w37)
        call "Enqueue Message (Single).gvi"(message queue in=w36, message="Wait For Event", error in=w37) -> (error out=w18)
        w19 = s2
        w20 = default
        w21 = s3
      }
      frame "Wait For Event" {
        call "Enqueue Message (Single).gvi"(message queue in=w14, message="Watchdog", error in=w17) -> (error out=w18)
        w19 = s2
        w20 = default
        w21 = s3
      }
      frame "Initialize VISA" {
        call "Configure Serial Port (Instr).gvi"(stop bits="1.0"(10), session in=$"VISA Resource Name", baud rate=115200, parity="None"(0), termination char=0xA, enable termination char=TRUE) -> (session out=w38, error out=w39)
        call "Open (Instr).gvi"(resource name=w38, error in=w39) -> (session out=w40, error out=w41)
        Property Node(instance in=s3, "VISA Resource"=w40) -> (instance out=w21)
        Wait(time to wait=2000)
        Merge Errors(w41, w17) -> (error out=w18)
        w19 = s2
        w20 = default
      }
      frame "Initialize SLC" {
        call "Open Configuration API Key.gvi"(server url=$"Server Url", api key=$"Api Key") -> (configuration=w42, error out=w43)
        call "Open Tag.gvi"(path="PV_T", data type="String", error in=w43, configuration=w42) -> (tag=w44, error out=w45)
        Property Node(instance in=s3, "tag"=w44, "configuration"=w42) -> (instance out=w21)
        Wait(time to wait=2000)
        Merge Errors(w45, w17) -> (error out=w18)
        w19 = s2
        w20 = default
      }
      frame "Initialize AI" {
        call "DAQmx Create Channel (AI-Voltage-Basic).gvi"(physical channels="Dev1/ai0:1,Dev1/ai3,Dev1/ai7", units="Volts"(10348), measurement range="ValueRange.gtype" {"maximum value"=10, "minimum value"=0}, input terminal configuration="RSE"(10083)) -> (task out=w46, error out=w47)
        Property Node(instance in=s3, "Physical Channel"=w46) -> (instance out=w21)
        Merge Errors(w47, w17) -> (error out=w18)
        w19 = s2
        w20 = default
      }
      frame "Send CMD" {
        Property Node(instance in=s3) -> ("VISA Resource"=w48, instance out=w21)
        call "Read_Write_VISA.gvi"(VISA_IN=w48, CMD=$"write buffer", ERROR_IN=w17) -> (TAG=w49, ERROR_OUT=w50)
        $CMD <- w49
        call "Enqueue Message (Single).gvi"(message queue in=w14, message="Wait For Event", error in=w50) -> (error out=w18)
        w19 = s2
        w20 = default
      }
      frame "PV Config" {
        Variant To Data(error in (no error)=w17, type=string "", variant=w16) -> (data=w51, error out=w52)
        Property Node(instance in=s3) -> ("VISA Resource"=w53, instance out=w21)
        call "PV_switch.gvi"(VISA_IN=w53, CTRL="Disconnect", ERROR_IN=w52) -> (VISA_OUT=w54, ERROR_OUT=w55)
        case (w51) {
          frame "Single", Default {
            w58 = ["@DO 17 0#", "@DO 18 1#", "@DO 23 1#", "@DO 24 1#", "@DO 25 1#", "@DO 26 0#", "@DO 27 0#", "@DO 28 0#", "@DO 29 1#", "@DO 30 1#", "@DO 31 1#", "@DO 32 1#", "@DO 33 0#"]
            w59 = ["@DO 54 1#", "@DO 55 1#", "@DO 56 1#", "@DO 57 1#", "@DO 58 1#", "@DO 59 1#", "@DO 60 1#", "@DO 61 1#"]
            # @DO 17 0#
            # @DO 18 1#
            # @DO 23 1#
            # @DO 24 1#
            # @DO 25 1#
            # @DO 26 0#
            # @DO 27 0#
            # @DO 28 0#
            # @DO 29 1#
            # @DO 30 1#
            # @DO 31 1#
            # @DO 32 1#
            # @DO 33 0#
            #
            # 03,08,2020
            # 19:51
            Insert Into Array(inArray=w58, new=w59) -> w60
            call "CMD_Iteration.gvi"(VISA_IN=w54, ARRAY_IN=w60, ERROR_IN=w55) -> (VISA Answer=w57, ERROR_OUT=w56)
          }
          frame "Parallel 2" {
            # @DO 17 1#
            # @DO 18 0#
            # @DO 23 1#
            # @DO 24 0#
            # @DO 25 1#
            # @DO 26 1#
            # @DO 27 1#
            # @DO 28 1#
            # @DO 29 1#
            # @DO 30 1#
            # @DO 31 1#
            # @DO 32 1#
            # @DO 33 1#
            #
            # 03.08.2020
            # 19.53
            w61 = ["@DO 17 1#", "@DO 18 0#", "@DO 23 1#", "@DO 24 0#", "@DO 25 1#", "@DO 26 1#", "@DO 27 1#", "@DO 28 1#", "@DO 29 1#", "@DO 30 1#", "@DO 31 1#", "@DO 32 1#", "@DO 33 1#"]
            # Disconnect all Diodes
            w62 = ["@DO 54 1#", "@DO 55 1#", "@DO 56 1#", "@DO 57 1#", "@DO 58 1#", "@DO 59 1#", "@DO 60 1#", "@DO 61 1#"]
            Insert Into Array(inArray=w61, new=w62) -> w63
            call "CMD_Iteration.gvi"(VISA_IN=w54, ARRAY_IN=w63, ERROR_IN=w55) -> (VISA Answer=w57, ERROR_OUT=w56)
          }
          frame "Parallel 2 Diode" {
            # @DO 17 1#
            # @DO 18 0#
            # @DO 23 1#
            # @DO 24 0#
            # @DO 25 1#
            # @DO 26 1#
            # @DO 27 1#
            # @DO 28 1#
            # @DO 29 1#
            # @DO 30 1#
            # @DO 31 1#
            # @DO 32 1#
            # @DO 33 1#
            #
            # 03.08.2020
            # 19.54
            w64 = ["@DO 17 1#", "@DO 18 0#", "@DO 23 1#", "@DO 24 0#", "@DO 25 1#", "@DO 26 1#", "@DO 27 1#", "@DO 28 1#", "@DO 29 1#", "@DO 30 1#", "@DO 31 1#", "@DO 32 1#", "@DO 33 1#"]
            # @DO 56 0#
            # @DO 57 0#
            #
            # 19.54
            w65 = ["@DO 54 1#", "@DO 55 1#", "@DO 56 0#", "@DO 57 0#", "@DO 58 1#", "@DO 59 1#", "@DO 60 1#", "@DO 61 1#"]
            Insert Into Array(inArray=w64, new=w65) -> w66
            call "CMD_Iteration.gvi"(VISA_IN=w54, ARRAY_IN=w66, ERROR_IN=w55) -> (VISA Answer=w57, ERROR_OUT=w56)
          }
          frame "Series 2" {
            # @DO 17 0#
            # @DO 18 1#
            # @DO 23 1#
            # @DO 24 0#
            # @DO 25 1#
            # @DO 26 1#
            # @DO 27 1#
            # @DO 28 1#
            # @DO 29 0#
            # @DO 30 1#
            # @DO 31 1#
            # @DO 32 0#
            # @DO 33 0#
            #
            # 03.08.2020
            # 19.55
            w67 = ["@DO 17 0#", "@DO 18 1#", "@DO 23 1#", "@DO 24 0#", "@DO 25 1#", "@DO 26 1#", "@DO 27 1#", "@DO 28 1#", "@DO 29 0#", "@DO 30 1#", "@DO 31 1#", "@DO 32 0#", "@DO 33 0#"]
            w68 = ["@DO 54 1#", "@DO 55 1#", "@DO 56 1#", "@DO 57 1#", "@DO 58 1#", "@DO 59 1#", "@DO 60 1#", "@DO 61 1#"]
            Insert Into Array(inArray=w67, new=w68) -> w69
            call "CMD_Iteration.gvi"(VISA_IN=w54, ARRAY_IN=w69, ERROR_IN=w55) -> (VISA Answer=w57, ERROR_OUT=w56)
          }
          frame "Series 2 Diode" {
            # @DO 17 0#
            # @DO 18 1#
            # @DO 23 1#
            # @DO 24 0#
            # @DO 25 1#
            # @DO 26 1#
            # @DO 27 1#
            # @DO 28 1#
            # @DO 29 0#
            # @DO 30 1#
            # @DO 31 1#
            # @DO 32 0#
            # @DO 33 0#
            #
            # 03.08.2020
            # 19.57
            w70 = ["@DO 17 0#", "@DO 18 1#", "@DO 23 1#", "@DO 24 0#", "@DO 25 1#", "@DO 26 1#", "@DO 27 1#", "@DO 28 1#", "@DO 29 0#", "@DO 30 1#", "@DO 31 1#", "@DO 32 0#", "@DO 33 0#"]
            # @DO 60 0#
            # @DO 61 0#
            #
            # 03.08.2020
            w71 = ["@DO 54 1#", "@DO 55 1#", "@DO 56 1#", "@DO 57 1#", "@DO 58 1#", "@DO 59 1#", "@DO 60 0#", "@DO 61 0#"]
            Insert Into Array(inArray=w70, new=w71) -> w72
            call "CMD_Iteration.gvi"(VISA_IN=w54, ARRAY_IN=w72, ERROR_IN=w55) -> (VISA Answer=w57, ERROR_OUT=w56)
          }
          frame "Parallel 4" {
            # @DO 17 1#
            # @DO 18 1#
            # @DO 23 1#
            # @DO 24 1#
            # @DO 25 1#
            # @DO 26 1#
            # @DO 27 1#
            # @DO 28 1#
            # @DO 29 1#
            # @DO 30 1#
            # @DO 31 1#
            # @DO 32 1#
            # @DO 33 1#
            #
            # 03.08.2020
            # 19.59
            w73 = ["@DO 17 1#", "@DO 18 1#", "@DO 23 1#", "@DO 24 1#", "@DO 25 1#", "@DO 26 1#", "@DO 27 1#", "@DO 28 1#", "@DO 29 1#", "@DO 30 1#", "@DO 31 1#", "@DO 32 1#", "@DO 33 1#"]
            w74 = ["@DO 54 1#", "@DO 55 1#", "@DO 56 1#", "@DO 57 1#", "@DO 58 1#", "@DO 59 1#", "@DO 60 1#", "@DO 61 1#"]
            Insert Into Array(inArray=w73, new=w74) -> w75
            call "CMD_Iteration.gvi"(VISA_IN=w54, ARRAY_IN=w75, ERROR_IN=w55) -> (VISA Answer=w57, ERROR_OUT=w56)
          }
          frame "Parallel 4 Diode" {
            # @DO 17 1#
            # @DO 18 1#
            # @DO 23 1#
            # @DO 24 1#
            # @DO 25 1#
            # @DO 26 1#
            # @DO 27 1#
            # @DO 28 1#
            # @DO 29 1#
            # @DO 30 1#
            # @DO 31 1#
            # @DO 32 1#
            # @DO 33 1#
            # 03.08.2020
            # 20.00
            w76 = ["@DO 17 1#", "@DO 18 1#", "@DO 23 1#", "@DO 24 1#", "@DO 25 1#", "@DO 26 1#", "@DO 27 1#", "@DO 28 1#", "@DO 29 1#", "@DO 30 1#", "@DO 31 1#", "@DO 32 1#", "@DO 33 1#"]
            # @DO 54 0#
            # @DO 55 0#
            # @DO 56 0#
            # @DO 57 0#
            #
            # 03.08.2020
            # 20.00
            w77 = ["@DO 54 0#", "@DO 55 0#", "@DO 56 0#", "@DO 57 0#", "@DO 58 1#", "@DO 59 1#", "@DO 60 1#", "@DO 61 1#"]
            Insert Into Array(inArray=w76, new=w77) -> w78
            call "CMD_Iteration.gvi"(VISA_IN=w54, ARRAY_IN=w78, ERROR_IN=w55) -> (VISA Answer=w57, ERROR_OUT=w56)
          }
          frame "Series 4" {
            # @DO 17 0#
            # @DO 18 1#
            # @DO 23 0#
            # @DO 24 1#
            # @DO 25 1#
            # @DO 26 0#
            # @DO 27 0#
            # @DO 28 0#
            # @DO 29 0#
            # @DO 30 0#
            # @DO 31 0#
            # @DO 32 0#
            # @DO 33 0#
            #
            # 03.08.2020
            # 20.02
            w79 = ["@DO 17 0#", "@DO 18 1#", "@DO 23 0#", "@DO 24 1#", "@DO 25 1#", "@DO 26 0#", "@DO 27 0#", "@DO 28 0#", "@DO 29 0#", "@DO 30 0#", "@DO 31 0#", "@DO 32 0#", "@DO 33 0#"]
            w80 = ["@DO 54 1#", "@DO 55 1#", "@DO 56 1#", "@DO 57 1#", "@DO 58 1#", "@DO 59 1#", "@DO 60 1#", "@DO 61 1#"]
            Insert Into Array(inArray=w79, new=w80) -> w81
            call "CMD_Iteration.gvi"(VISA_IN=w54, ARRAY_IN=w81, ERROR_IN=w55) -> (VISA Answer=w57, ERROR_OUT=w56)
          }
          frame "Series 4 Diode" {
            # @DO 17 0#
            # @DO 18 1#
            # @DO 23 0#
            # @DO 24 1#
            # @DO 25 1#
            # @DO 26 0#
            # @DO 27 0#
            # @DO 28 0#
            # @DO 29 0#
            # @DO 30 0#
            # @DO 31 0#
            # @DO 32 0#
            # @DO 33 0#
            #
            # 03.08.2020
            # 20.03
            w82 = ["@DO 17 0#", "@DO 18 1#", "@DO 23 0#", "@DO 24 1#", "@DO 25 1#", "@DO 26 0#", "@DO 27 0#", "@DO 28 0#", "@DO 29 0#", "@DO 30 0#", "@DO 31 0#", "@DO 32 0#", "@DO 33 0#"]
            # @DO 58 0#
            # @DO 59 0#
            # @DO 60 0#
            # @DO 61 0#
            #
            # 03.08.2020
            # 20.04
            w83 = ["@DO 54 1#", "@DO 55 1#", "@DO 56 1#", "@DO 57 1#", "@DO 58 0#", "@DO 59 0#", "@DO 60 0#", "@DO 61 0#"]
            Insert Into Array(inArray=w82, new=w83) -> w84
            call "CMD_Iteration.gvi"(VISA_IN=w54, ARRAY_IN=w84, ERROR_IN=w55) -> (VISA Answer=w57, ERROR_OUT=w56)
          }
          frame "Parallel Of Series" {
            # @DO 17 1#
            # @DO 18 1#
            # @DO 23 1#
            # @DO 24 1#
            # @DO 25 1#
            # @DO 26 1#
            # @DO 27 0#
            # @DO 28 1#
            # @DO 29 0#
            # @DO 30 0#
            # @DO 31 1#
            # @DO 32 0#
            # @DO 33 1#
            #
            # 03.08.2020
            # 20.05
            w85 = ["@DO 17 1#", "@DO 18 1#", "@DO 23 1#", "@DO 24 1#", "@DO 25 1#", "@DO 26 1#", "@DO 27 0#", "@DO 28 1#", "@DO 29 0#", "@DO 30 0#", "@DO 31 1#", "@DO 32 0#", "@DO 33 1#"]
            w86 = ["@DO 54 1#", "@DO 55 1#", "@DO 56 1#", "@DO 57 1#", "@DO 58 1#", "@DO 59 1#", "@DO 60 1#", "@DO 61 1#"]
            Insert Into Array(inArray=w85, new=w86) -> w87
            call "CMD_Iteration.gvi"(VISA_IN=w54, ARRAY_IN=w87, ERROR_IN=w55) -> (VISA Answer=w57, ERROR_OUT=w56)
          }
          frame "Parallel Of Series Diode" {
            # @DO 17 1#
            # @DO 18 1#
            # @DO 23 1#
            # @DO 24 1#
            # @DO 25 1#
            # @DO 26 1#
            # @DO 27 0#
            # @DO 28 1#
            # @DO 29 0#
            # @DO 30 0#
            # @DO 31 1#
            # @DO 32 0#
            # @DO 33 1#
            #
            # 03.08.2020
            # 20.06
            # @DO 58 0#
            # @DO 59 0#
            # @DO 60 0#
            # @DO 61 0#
            #
            # 03.08.2020
            # 20.097
            w88 = ["@DO 17 1#", "@DO 18 1#", "@DO 23 1#", "@DO 24 1#", "@DO 25 1#", "@DO 26 1#", "@DO 27 0#", "@DO 28 1#", "@DO 29 0#", "@DO 30 0#", "@DO 31 1#", "@DO 32 0#", "@DO 33 1#"]
            w89 = ["@DO 54 1#", "@DO 55 1#", "@DO 56 1#", "@DO 57 1#", "@DO 58 0#", "@DO 59 0#", "@DO 60 0#", "@DO 61 0#"]
            Insert Into Array(inArray=w88, new=w89) -> w90
            call "CMD_Iteration.gvi"(VISA_IN=w54, ARRAY_IN=w90, ERROR_IN=w55) -> (VISA Answer=w57, ERROR_OUT=w56)
          }
          frame "Series Of Parallel" {
            w91 = ["@DO 54 1#", "@DO 55 1#", "@DO 56 1#", "@DO 57 1#", "@DO 58 1#", "@DO 59 1#", "@DO 60 1#", "@DO 61 1#"]
            # @DO 17 1#
            # @DO 18 0#
            # @DO 23 0#
            # @DO 24 0#
            # @DO 25 0#
            # @DO 26 1#
            # @DO 27 1#
            # @DO 28 1#
            # @DO 29 1#
            # @DO 30 1#
            # @DO 31 1#
            # @DO 32 1#
            # @DO 33 1#
            #
            # 03.08.2020
            # 20.07
            w92 = ["@DO 17 1#", "@DO 18 0#", "@DO 23 0#", "@DO 24 0#", "@DO 25 0#", "@DO 26 1#", "@DO 27 1#", "@DO 28 1#", "@DO 29 1#", "@DO 30 1#", "@DO 31 1#", "@DO 32 1#", "@DO 33 1#"]
            Insert Into Array(inArray=w92, new=w91) -> w93
            call "CMD_Iteration.gvi"(VISA_IN=w54, ARRAY_IN=w93, ERROR_IN=w55) -> (VISA Answer=w57, ERROR_OUT=w56)
          }
          frame "Series Of Parallel Diode" {
            # @DO 17 1#
            # @DO 18 0#
            # @DO 23 0#
            # @DO 24 0#
            # @DO 25 0#
            # @DO 26 1#
            # @DO 27 1#
            # @DO 28 1#
            # @DO 29 1#
            # @DO 30 1#
            # @DO 31 1#
            # @DO 32 1#
            # @DO 33 1#
            #
            # 03.08.2020
            # 20.08
            w94 = ["@DO 17 1#", "@DO 18 0#", "@DO 23 0#", "@DO 24 0#", "@DO 25 0#", "@DO 26 1#", "@DO 27 1#", "@DO 28 1#", "@DO 29 1#", "@DO 30 1#", "@DO 31 1#", "@DO 32 1#", "@DO 33 1#"]
            # @DO 54 0#
            # @DO 55 0#
            # @DO 56 0#
            # @DO 57 0#
            #
            # 20.09
            # 03.08.2020
            w95 = ["@DO 54 0#", "@DO 55 0#", "@DO 56 0#", "@DO 57 0#", "@DO 58 1#", "@DO 59 1#", "@DO 60 1#", "@DO 61 1#"]
            Insert Into Array(inArray=w94, new=w95) -> w96
            call "CMD_Iteration.gvi"(VISA_IN=w54, ARRAY_IN=w96, ERROR_IN=w55) -> (VISA Answer=w57, ERROR_OUT=w56)
          }
        }
        call "PV_switch.gvi"(VISA_IN=w53, CTRL="Connect", ERROR_IN=w56) -> (ERROR_OUT=w18)
        case (w18) {
          frame Error, Default { }
          frame No Error {
            $"Status PV Config" <- w51
            Property Node(instance in=reference to "PV-Connecting Solar Panels", "ValueSignaling"=w51)
          }
        }
        $"VISA Answer" <- w57
        w19 = s2
        w20 = default
      }
      frame "Reset CVM" {
        Property Node(instance in=s3) -> ("VISA Resource"=w97, instance out=w21)
        # VOLTAGE RANGE
        # @DO 51 0#
        # @DO 52 0#
        # @DO 53 0#
        # CURRENT RANGE
        # @DO 50 1#
        call "CMD_Iteration.gvi"(VISA_IN=w97, ARRAY_IN=["@DO 51 1#", "@DO 52 1#", "@DO 53 1#"], ERROR_IN=w17) -> (VISA_OUT=w98, ERROR_OUT=w99)
        call "CMD_Iteration.gvi"(VISA_IN=w98, ARRAY_IN=["@DO 50 1#"], ERROR_IN=w99) -> (ERROR_OUT=w18)
        $"Voltage coeff" <- 1
        $"Current coeff" <- 1
        w19 = s2
        w20 = default
      }
      frame "VAC" {
        w100 = ["0", "1,", "10,", "20,10,", "50,", "50,20,", "100,", "100,40,10,", "200,100,", "500,100,", "1000,", "2000,", "2000,1000,", "4000,", "4000,1000,", "4000,2000,", "4000,2000,1000,", "4000,2000,1000,500,400,100,"]
        Array Size(array=w100) -> (size(s)=w101)
        Is Less Or Equal(x=$"VAC Load Counter", y=w101) -> w102
        Property Node(instance in=s3) -> ("VISA Resource"=w103, "Physical Channel"=w104, instance out=w21)
        Variant To Data(type=timestamp 1904-01-01T00:00:00Z, variant=w16) -> (data=w105)
        Get Current Time() -> (current time=w106)
        Timestamp Subtract(x=w106, y=w105) -> w107
        Is Greater Or Equal(x=w107, y=5) -> w108
        Logical And(w108, w102) -> w109
        call "DAQmx Read (Analog 2D DBL NChan NSamp).gvi"(task in=w104, number of samples per channel=1) -> (data=w110)
        Array Index(array=w110) -> (out0[1, 0]=w111)
        Multiply(w111, 4) -> w112
        Feedback Node(input=w113) -> w114
        Build Array(w114, w112) -> w113
        Array Index(array=w110) -> (out0[0, 0]=w115)
        Divide(x=w115, y=70) -> w116
        Multiply(w116, 1000) -> w117
        Feedback Node(input=w118) -> w119
        Build Array(w119, w117) -> w118
        Build Cluster(w113, w118) -> w120
        case (w109) {
          frame False, Default {
            w121 = w17
            w122 = w105
            w123 = $"VAC Load Counter"
          }
          frame True {
            Get Current Time() -> (current time=w122)
            # Disconnect ALL load
            Array Index(array=w100) -> (out0[$"VAC Load Counter"]=w124)
            w125 = ["@DO 42 1#", "@DO 34 0#", "@DO 35 0#", "@DO 36 0#", "@DO 37 0#", "@DO 38 0#", "@DO 39 0#", "@DO 40 0#", "@DO 41 0#", "@DO 43 0#", "@DO 44 0#", "@DO 45 0#", "@DO 46 0#", "@DO 47 0#", "@DO 48 0#", "@DO 49 0#"]
            call "CMD_Iteration.gvi"(VISA_IN=w103, ARRAY_IN=w125, ERROR_IN=w17) -> (ERROR_OUT=w126)
            s4 = w124  # shift register
            while {
              Match Pattern(regular expression=",", string=s4) -> (after substring=w127, before substring=w128)
              case (w128) {
                frame "1", Default {
                  call "Read_Write_VISA.gvi"(VISA_IN=w103, CMD="@DO 43 1#", ERROR_IN=w126) -> (ERROR_OUT=w129)
                }
                frame "2" {
                  call "Read_Write_VISA.gvi"(VISA_IN=w103, CMD="@DO 44 1#", ERROR_IN=w126) -> (ERROR_OUT=w129)
                }
                frame "3" {
                  call "Read_Write_VISA.gvi"(VISA_IN=w103, CMD="@DO 45 1#", ERROR_IN=w126) -> (ERROR_OUT=w129)
                }
                frame "5" {
                  call "Read_Write_VISA.gvi"(VISA_IN=w103, CMD="@DO 46 1#", ERROR_IN=w126) -> (ERROR_OUT=w129)
                }
                frame "10" {
                  call "Read_Write_VISA.gvi"(VISA_IN=w103, CMD="@DO 47 1#", ERROR_IN=w126) -> (ERROR_OUT=w129)
                }
                frame "20" {
                  call "Read_Write_VISA.gvi"(VISA_IN=w103, CMD="@DO 48 1#", ERROR_IN=w126) -> (ERROR_OUT=w129)
                }
                frame "40" {
                  call "Read_Write_VISA.gvi"(VISA_IN=w103, CMD="@DO 49 1#", ERROR_IN=w126) -> (ERROR_OUT=w129)
                }
                frame "50" {
                  call "Read_Write_VISA.gvi"(VISA_IN=w103, CMD="@DO 34 1#", ERROR_IN=w126) -> (ERROR_OUT=w129)
                }
                frame "100" {
                  call "Read_Write_VISA.gvi"(VISA_IN=w103, CMD="@DO 35 1#", ERROR_IN=w126) -> (ERROR_OUT=w129)
                }
                frame "200" {
                  call "Read_Write_VISA.gvi"(VISA_IN=w103, CMD="@DO 36 1#", ERROR_IN=w126) -> (ERROR_OUT=w129)
                }
                frame "400" {
                  call "Read_Write_VISA.gvi"(VISA_IN=w103, CMD="@DO 37 1#", ERROR_IN=w126) -> (ERROR_OUT=w129)
                }
                frame "500" {
                  call "Read_Write_VISA.gvi"(VISA_IN=w103, CMD="@DO 38 1#", ERROR_IN=w126) -> (ERROR_OUT=w129)
                }
                frame "1000" {
                  call "Read_Write_VISA.gvi"(VISA_IN=w103, CMD="@DO 39 1#", ERROR_IN=w126) -> (ERROR_OUT=w129)
                }
                frame "2000" {
                  call "Read_Write_VISA.gvi"(VISA_IN=w103, CMD="@DO 40 1#", ERROR_IN=w126) -> (ERROR_OUT=w129)
                }
                frame "4000" {
                  call "Read_Write_VISA.gvi"(VISA_IN=w103, CMD="@DO 41 1#", ERROR_IN=w126) -> (ERROR_OUT=w129)
                }
                frame "0" {
                  # Для измерения тока К.З.
                  # Схема сопротивления
                  # 1 Ом + 1 Ом токовый резистор
                  w129 = w126
                }
              }
              Is Empty String Or Path(string/path=w127) -> w130
              next s4 = w127
              stop if w130
            }
            call "Read_Write_VISA.gvi"(VISA_IN=w103, CMD="@DO 42 0#", ERROR_IN=w129) -> (ERROR_OUT=w121)
            Increment(x=$"VAC Load Counter") -> w123
            $Graph_3 <- w120
          }
        }
        call "Enqueue Message (Single).gvi"(message queue in=w14, message="Watchdog", error in=w121) -> (error out=w131)
        case (w102) {
          frame False, Default {
            w18 = w131
          }
          frame True {
            call "Enqueue Message (Single).gvi"(message queue in=w14, message="VAC", message data=w122, error in=w131) -> (error out=w18)
          }
        }
        $"VAC Load Counter" <- w123
        w19 = s2
        w20 = default
      }
      frame "Prepare CVM" {
        Property Node(instance in=s3) -> ("VISA Resource"=w132, "Physical Channel"=w133, instance out=w21)
        call "DAQmx Read (Analog 2D DBL NChan NSamp).gvi"(task in=w133, error in=w17, number of samples per channel=1) -> (error out=w134, data=w135)
        Array Index(array=w135) -> (out0[2, 0]=w136)
        Multiply(w136, 4) -> w137
        C Code Node("x"=w137) -> ("y"=w138, Error Out=w139)
        ~~~
        if(x>-1 && x<=1)
          y = 0;
        if(x>1 && x<=10)
          y = 1;
        if(x>10 && x<=20)
          y = 2;
        if(x>20 && x<=30)
          y = 3;
        ~~~
        $"Voltage Range" <- w138
        # Voltage Range
        case (w138) {
          frame 0, Default {
            call "CMD_Iteration.gvi"(VISA_IN=w132, ARRAY_IN=["@DO 51 1#", "@DO 52 1#", "@DO 53 0#"], ERROR_IN=w139) -> (VISA Answer=w142, ERROR_OUT=w140)
            w141 = 0.1
          }
          frame 1 {
            call "CMD_Iteration.gvi"(VISA_IN=w132, ARRAY_IN=["@DO 51 1#", "@DO 52 1#", "@DO 53 1#"], ERROR_IN=w139) -> (VISA Answer=w142, ERROR_OUT=w140)
            w141 = 1
          }
          frame 2 {
            call "CMD_Iteration.gvi"(VISA_IN=w132, ARRAY_IN=["@DO 51 1#", "@DO 52 0#", "@DO 53 1#"], ERROR_IN=w139) -> (VISA Answer=w142, ERROR_OUT=w140)
            w141 = 0.5
          }
          frame 3 {
            # Div x0.25 works with 2 relay
            call "CMD_Iteration.gvi"(VISA_IN=w132, ARRAY_IN=["@DO 51 0#\n"], ERROR_IN=w139) -> (VISA Answer=w142, ERROR_OUT=w140)
            w141 = 0.25
          }
        }
        $"Voltage coeff" <- w141
        $"VISA Answer_2" <- w142
        Array Index(array=w135) -> (out0[3, 0]=w143)
        # Tip For Local Wiring Solution
        # Relay 1(50) 	DO 1- REP A x1
        # 		DO 0- AMP A x10
        #
        # Relay 2(51) 	DO 1-REP V x1
        # 		DO 0-DIV V x0.25
        # Relay 3(52) 	DO 1-REP V x1
        # 		DO 0-DIV V x0.5
        # Relay 4(53) 	DO 1-REP V x1
        # 		DO 0-AMP V x10
        C Code Node("x"=w143) -> ("y"=w144)
        ~~~
        if(x>-1 && x<=0.6)
          y = 0;
        if(x>0.6 && x<=6)
          y = 1;
        ~~~
        # Current Range
        case (w144) {
          frame 0, Default {
            call "CMD_Iteration.gvi"(VISA_IN=w132, ARRAY_IN=["@DO 50 0#"]) -> (ERROR_OUT=w145)
            w146 = 0.1
          }
          frame 1 {
            call "CMD_Iteration.gvi"(VISA_IN=w132, ARRAY_IN=["@DO 50 1#"]) -> (ERROR_OUT=w145)
            w146 = 1
          }
        }
        $"Current coeff" <- w146
        Merge Errors(w140, w145, w134) -> (error out=w18)
        w19 = s2
        w20 = default
      }
      frame "Fans Control" {
        Property Node(instance in=s3) -> ("VISA Resource"=w147, instance out=w21)
        Variant To Data(error in (no error)=w17, type=string "", variant=w16) -> (data=w148, error out=w149)
        case (w148) {
          frame "Turn All Off", Default {
            w150 = ["@DO 7 0#", "@DO 8 0#"]
          }
          frame "Turn All On" {
            w150 = ["@DO 7 1#", "@DO 8 1#"]
          }
          frame "Turn 1,2 On" {
            w150 = ["@DO 7 1#", "@DO 8 0#", ""]
          }
          frame "Turn 3,4 On" {
            w150 = ["@DO 8 1#", "@DO 7 0#"]
          }
        }
        call "CMD_Iteration.gvi"(VISA_IN=w147, ARRAY_IN=w150, ERROR_IN=w149) -> (ERROR_OUT=w18)
        w19 = s2
        w20 = default
      }
      frame "Heat Config" {
        Property Node(instance in=s3) -> ("VISA Resource"=w151, instance out=w21)
        Variant To Data(error in (no error)=w17, type=string "", variant=w16) -> (data=w152, error out=w153)
        case (w152) {
          frame "No Heat", Default {
            w154 = ["@PWM 9 0#"]
          }
          frame "50 Heat" {
            w154 = ["@PWM 9 125#"]
          }
          frame "100 Heat" {
            w154 = ["@PWM 9 255#"]
          }
        }
        call "CMD_Iteration.gvi"(VISA_IN=w151, ARRAY_IN=w154, ERROR_IN=w153) -> (ERROR_OUT=w18)
        w19 = s2
        w20 = default
      }
      frame "Set Time" {
        Property Node(instance in=s3) -> ("VISA Resource"=w155, instance out=w21)
        Variant To Data(error in (no error)=w17, type=string "", variant=w16) -> (data=w156, error out=w157)
        case (w156) {
          frame "Turn All Off", Default {
            w158 = ["@DO 7 1#", "@DO 8 1#"]
          }
          frame "Turn All On" {
            w158 = ["@DO 7 0#", "@DO 8 0#"]
          }
          frame "Turn 1,2 On" {
            w158 = ["@DO 7 1#", "@DO 8 0#", ""]
          }
          frame "Turn 3,4 On" {
            w158 = ["@DO 8 1#", "@DO 7 0#"]
          }
        }
        call "CMD_Iteration.gvi"(VISA_IN=w155, ARRAY_IN=w158, ERROR_IN=w157) -> (ERROR_OUT=w18)
        # Послать команду Settime
        #
        # Лучше всего посылать время, но если не выйдет- слово
        disable {
          frame Enabled { }
          frame Disabled {
            Get Current Time()
          }
        }
        w19 = s2
        w20 = default
      }
      frame "Optic Filter Config" {
        Property Node(instance in=s3) -> ("VISA Resource"=w159, instance out=w21)
        Variant To Data(error in (no error)=w17, type=string "", variant=w16) -> (data=w160, error out=w161)
        case (w160) {
          frame "None", Default {
            w162 = ["@SERV 3 90#", "@SERV 4 0#"]
          }
          frame "Filter 1" {
            w162 = ["@SERV 3 90#", "@SERV 4 0#", "@SERV 3 0#"]
          }
          frame "Filter 2" {
            w162 = ["@SERV 3 90#", "@SERV 4 0#", "@SERV 4 90#"]
          }
        }
        call "CMD_Iteration.gvi"(VISA_IN=w159, ARRAY_IN=w162, ERROR_IN=w161) -> (ERROR_OUT=w18)
        w19 = s2
        w20 = default
      }
      frame "Set PV Angle" {
        Property Node(instance in=s3) -> ("VISA Resource"=w163, instance out=w21)
        Variant To Data(error in (no error)=w17, type=u32 0, variant=w16) -> (data=w164, error out=w165)
        # Set angle limits for PV panels
        In Range And Coerce(lower limit=0, upper limit=180, x=w164) -> (coerced(x)=w166)
        Number To Decimal String(number=w166) -> (decimal integer string=w167)
        Concatenate Strings("@SERV 13 ", w167, " #") -> w168
        call "Read_Write_VISA.gvi"(VISA_IN=w163, CMD=w168, ERROR_IN=w165) -> (ERROR_OUT=w18)
        w19 = s2
        w20 = default
      }
      frame "Brightness Config" {
        Property Node(instance in=s3) -> ("VISA Resource"=w169, instance out=w21)
        Variant To Data(error in (no error)=w17, type=u32 0, variant=w16) -> (data=w170, error out=w171)
        # Set brightness limits
        In Range And Coerce(lower limit=0, upper limit=100, x=w170) -> (coerced(x)=w172)
        Number To Decimal String(number=w172) -> (decimal integer string=w173)
        Concatenate Strings("@DIM 6 ", w173, " #") -> w174
        call "Read_Write_VISA.gvi"(VISA_IN=w169, CMD=w174, ERROR_IN=w171) -> (ERROR_OUT=w18)
        w19 = s2
        w20 = default
      }
      frame "IR Thermometer" {
        Property Node(instance in=s3) -> ("VISA Resource"=w175, instance out=w21)
        Variant To Data(error in (no error)=w17, type=string "", variant=w16) -> (data=w176, error out=w177)
        case (w176) {
          frame "None", Default {
            w178 = "@SERV 5 0#"
          }
          frame "Panel 1" {
            w178 = "@SERV 5 50#"
          }
          frame "Panel 2" {
            w178 = "@SERV 5 90#"
          }
          frame "Panel 3" {
            w178 = "@SERV 5 120#"
          }
          frame "Panel 4" {
            w178 = "@SERV 5 150#"
          }
        }
        call "Read_Write_VISA.gvi"(VISA_IN=w175, CMD=w178, ERROR_IN=w177) -> (ERROR_OUT=w18)
        w19 = s2
        w20 = default
      }
      frame "Set Resistance" {
        Property Node(instance in=s3) -> ("VISA Resource"=w179, instance out=w21)
        Variant To Data(error in (no error)=w17, type=string "", variant=w16) -> (data=w180, error out=w181)
        # Disconnect ALL load
        w182 = ["@DO 42 1#", "@DO 34 0#", "@DO 35 0#", "@DO 36 0#", "@DO 37 0#", "@DO 38 0#", "@DO 39 0#", "@DO 40 0#", "@DO 41 0#", "@DO 43 0#", "@DO 44 0#", "@DO 45 0#", "@DO 46 0#", "@DO 47 0#", "@DO 48 0#", "@DO 49 0#"]
        call "CMD_Iteration.gvi"(VISA_IN=w179, ARRAY_IN=w182, ERROR_IN=w181) -> (VISA_OUT=w183, ERROR_OUT=w184)
        s5 = w180  # shift register
        while {
          Match Pattern(regular expression=",", string=s5) -> (after substring=w185, before substring=w186)
          case (w186) {
            frame "1", Default {
              call "Read_Write_VISA.gvi"(VISA_IN=w183, CMD="@DO 43 1#", ERROR_IN=w184) -> (ERROR_OUT=w187)
            }
            frame "2" {
              call "Read_Write_VISA.gvi"(VISA_IN=w183, CMD="@DO 44 1#", ERROR_IN=w184) -> (ERROR_OUT=w187)
            }
            frame "3" {
              call "Read_Write_VISA.gvi"(VISA_IN=w183, CMD="@DO 45 1#", ERROR_IN=w184) -> (ERROR_OUT=w187)
            }
            frame "5" {
              call "Read_Write_VISA.gvi"(VISA_IN=w183, CMD="@DO 46 1#", ERROR_IN=w184) -> (ERROR_OUT=w187)
            }
            frame "10" {
              call "Read_Write_VISA.gvi"(VISA_IN=w183, CMD="@DO 47 1#", ERROR_IN=w184) -> (ERROR_OUT=w187)
            }
            frame "20" {
              call "Read_Write_VISA.gvi"(VISA_IN=w183, CMD="@DO 48 1#", ERROR_IN=w184) -> (ERROR_OUT=w187)
            }
            frame "40" {
              call "Read_Write_VISA.gvi"(VISA_IN=w183, CMD="@DO 49 1#", ERROR_IN=w184) -> (ERROR_OUT=w187)
            }
            frame "50" {
              call "Read_Write_VISA.gvi"(VISA_IN=w183, CMD="@DO 34 1#", ERROR_IN=w184) -> (ERROR_OUT=w187)
            }
            frame "100" {
              call "Read_Write_VISA.gvi"(VISA_IN=w183, CMD="@DO 35 1#", ERROR_IN=w184) -> (ERROR_OUT=w187)
            }
            frame "200" {
              call "Read_Write_VISA.gvi"(VISA_IN=w183, CMD="@DO 36 1#", ERROR_IN=w184) -> (ERROR_OUT=w187)
            }
            frame "400" {
              call "Read_Write_VISA.gvi"(VISA_IN=w183, CMD="@DO 37 1#", ERROR_IN=w184) -> (ERROR_OUT=w187)
            }
            frame "500" {
              call "Read_Write_VISA.gvi"(VISA_IN=w183, CMD="@DO 38 1#", ERROR_IN=w184) -> (ERROR_OUT=w187)
            }
            frame "1000" {
              call "Read_Write_VISA.gvi"(VISA_IN=w183, CMD="@DO 39 1#", ERROR_IN=w184) -> (ERROR_OUT=w187)
            }
            frame "2000" {
              call "Read_Write_VISA.gvi"(VISA_IN=w183, CMD="@DO 40 1#", ERROR_IN=w184) -> (ERROR_OUT=w187)
            }
            frame "4000" {
              call "Read_Write_VISA.gvi"(VISA_IN=w183, CMD="@DO 41 1#", ERROR_IN=w184) -> (ERROR_OUT=w187)
            }
            frame "0" {
              # Для измерения тока К.З.
              # Схема сопротивления
              # 1 Ом + 1 Ом токовый резистор
              w187 = w184
            }
          }
          Is Empty String Or Path(string/path=w185) -> w188
          next s5 = w185
          stop if w188
        }
        # Connect Load
        call "Read_Write_VISA.gvi"(VISA_IN=w179, CMD="@DO 42 0#", ERROR_IN=w187) -> (ERROR_OUT=w18)
        w19 = s2
        w20 = default
      }
      frame "Reset Resistance" {
        Property Node(instance in=s3) -> ("VISA Resource"=w189, instance out=w21)
        # Размыкаются всё реле, сопротивление- бесконечность
        w190 = ["@DO 42 1#", "@DO 34 1#", "@DO 35 1#", "@DO 36 1#", "@DO 37 1#", "@DO 38 1#", "@DO 39 1#", "@DO 40 1#", "@DO 41 1#", "@DO 43 1#", "@DO 44 1#", "@DO 45 1#", "@DO 46 1#", "@DO 47 1#", "@DO 48 1#", "@DO 49 1#"]
        # Сопротивление в начальное положение
        call "CMD_Iteration.gvi"(VISA_IN=w189, ARRAY_IN=w190, ERROR_IN=w17) -> (ERROR_OUT=w18)
        w19 = s2
        w20 = default
      }
      frame "Watchdog" {
        Property Node(instance in=s3) -> ("Physical Channel"=w191, "VISA Resource"=w192, instance out=w21)
        call "DAQmx Read (Analog 2D DBL NChan NSamp).gvi"(task in=w191, number of samples per channel=1) -> (data=w193)
        Array Index(array=w193) -> (out0[1, 0]=w194)
        Multiply(w194, 4) -> w195
        Multiply(w195, $"Voltage coeff") -> w196
        Feedback Node(input=w197) -> w198
        Build Array(w198, w196) -> w197
        $Voltage_Graph <- w197
        $V_real <- w196
        Array Index(array=w193) -> (out0[0, 0]=w199)
        Divide(x=w199, y=70) -> w200
        Multiply(w200, 1000) -> w201
        Multiply(w201, $"Current coeff") -> w202
        $Current_real <- w202
        call "Read_Write_VISA.gvi"(VISA_IN=w192, CMD="@LUX 10 1#", ERROR_IN=w17) -> (OUTPUT=w203, TAG=w204, ERROR_OUT=w205)
        $LUX_2 <- w204
        call "Read_Write_VISA.gvi"(VISA_IN=w203, CMD="@TEMP 12 0#", ERROR_IN=w205) -> (TAG=w206, ERROR_OUT=w207)
        $TEMP_2 <- w206
        call "DAQmx Read (Analog 1D Wfm NChan NSamp).gvi"(task in=w191, error in=w207, number of samples per channel=1) -> (error out=w208, data=w209)
        $Chart <- w209
        Feedback Node(input=w210) -> w211
        Build Array(w211, w202) -> w210
        $Current_Graph <- w210
        call "Enqueue Message (Single).gvi"(message queue in=w14, message="Wait For Event", error in=w208) -> (error out=w18)
        w19 = s2
        w20 = default
      }
      frame "Error" {
        Variant To Data(error in (no error)=w17, type=no error, variant=w16) -> (data=w212, error out=w18)
        # #CodeRecommended - If you ever change the name of this "Error" message, you'll need to update the name in the Check Loop Error.vi as well.
        call "Display Error.gvi"(error in=w212)
        w19 = s2
        w20 = default
        w21 = s3
      }
      frame "Exit" {
        Generate User Event(event data=TRUE, user event=w3) -> (error out=w213)
        Release Queue(error in=w17, queue=w14) -> (error out=w214)
        Property Node(instance in=s3) -> ("VISA Resource"=w215, "Physical Channel"=w216, "tag"=w217, "configuration"=w218)
        call "Close Configuration.gvi"(configuration=w218) -> (error out=w219)
        call "Close Tag (Single).gvi"(tag=w217, error in=w219) -> (error out=w220)
        call "DAQmx Stop Task.gvi"(task in=w216, error in=w220) -> (error out=w221)
        call "Close (Instr).gvi"(session in=w215, error in=w221) -> (error out=w222)
        Merge Errors(w222, w213, w214) -> (error out=w18)
        w19 = s2
        w20 = TRUE
        w21 = default
      }
      frame Default {
        w223 = "The invalid message string \"%s\" was received in the Message Handling Loop."
        Format Into String(formatString=w223, w15) -> w224
        call "Build Error Cluster.gvi"(code=1, description=w224) -> (error out=w18)
        w19 = s2
        w20 = default
        w21 = s3
      }
    }
    call "Error Handler - Message Handling Loop.gvi"(message queue in=w14, error in=w18) -> (dup error in=w225)
    $Output <- w18
    next s2 = w19
    next s3 = w21
    stop if w20
  }
  disable {
    frame Enabled { }
    frame Disabled {
      call "Initialize.gvi"(device name="cam0") -> (session out=w226, error out=w227)
      call "Configure Grab.gvi"(session in=w226, error in=w227) -> (session out=w228, error out=w229)
      call "Create Image.gvi"(image name="image_1") -> (new image=w230)
      while {
        call "Grab.gvi"(session in=w228, error in=w229, image in=w230) -> (session out=w231, error out=w232, image out=w233)
        $Image <- w233
        stop if $Stop
      }
      call "Close.gvi"(session=w231, error in=w232)
    }
  }
